# Grasshopper definition 03_assignment1_ABMS_JM_LK _latest.gh (Grasshopper 1.0.7)
# plug-ins: ABxM.Grasshopper

# ---- group: Template
od_outdated = ColourSwatch(SwatchColor=RGBA(97, 97, 97, 150))
u_updated = ColourSwatch(SwatchColor=RGBA(208, 115, 230, 112))
o_outputs = ColourSwatch(SwatchColor=RGBA(160, 218, 242, 203))
toggle = BooleanToggle(True)
s_settings = ColourSwatch(SwatchColor=RGBA(224, 145, 81, 154))
g_general = ColourSwatch(SwatchColor=RGBA(245, 243, 237, 156))
y_yellow = ColourSwatch(SwatchColor=RGBA(247, 244, 64, 188))
i_inputs = ColourSwatch(SwatchColor=RGBA(125, 217, 98, 150))
c_core = ColourSwatch(SwatchColor=RGBA(235, 227, 206, 203))
r_red = ColourSwatch(SwatchColor=RGBA(242, 63, 63, 203))

change_background_color = Button()
toggle_2 = BooleanToggle(True)
button = Button()
button_2 = Button()
button_3 = Button()
changebackground = GhPythonScript(
    change=change_background_color,
    newBackgroundColor=ColourSwatch(SwatchColor=RGB(255, 255, 255)),
    wireColor=RGB(110, 110, 110),
    selectedWireColor=RGB(47, 255, 0))  # inputs newBackgroundColor: Color, wireColor: Color, selectedWireColor: Color
# ---------- changebackground: Python ----------
import Grasshopper as gh
import rhinoscriptsyntax as rs

newShadeColor = rs.CreateColor(0,0,0,20)
newEdgeColor = rs.CreateColor(0,0,0,40)

if(change):
     gh.GUI.Canvas.GH_Skin.canvas_back = newBackgroundColor
     gh.GUI.Canvas.GH_Skin.canvas_shade = newShadeColor
     gh.GUI.Canvas.GH_Skin.canvas_edge = newEdgeColor
     gh.GUI.Canvas.GH_Skin.wire_default = wireColor
     gh.GUI.Canvas.GH_Skin.wire_selected_a = selectedWireColor
     gh.GUI.Canvas.GH_Skin.wire_selected_b = selectedWireColor
# ---------- end changebackground ----------

# Do not modify this
# component without setting
# enable to false first!
toggle_3 = BooleanToggle(True)
colorgroups = CSharpScript(
    Colors=[i_inputs, s_settings, g_general, c_core, o_outputs, r_red, y_yellow, u_updated, od_outdated],
    Enable=toggle,
    Rename=toggle_2,
    RunOnce=button,
    Debug=toggle_3)  # -> out; inputs Colors: list of Color, Enable: Boolean, Rename: Boolean, RunOnce: Boolean, Debug: Boolean
# ---------- colorgroups: C# usings ----------
using System.Linq;
using System.Text;
using System.Reflection;
# ---------- colorgroups: C# ----------
    msg.Clear();


    this.Component.Message = "id: " + id.ToString();

    _debug = Debug; //Set to true to have all events printed in rhino log
    _rename = Rename;

    if (Enable)
    {
      msg.AppendFormat("Set up events on ID {0}\n", id);
      SetupDict(); // Create a dictionary of the input swatches
      SetEventHandlers(); // This would do the job.


    }
    else
    {
      RemoveEventHandlers();
    }
    if (RunOnce)
    {
      foreach(Grasshopper.Kernel.Special.GH_Group grp in Grasshopper.Instances.ActiveCanvas.Document.Objects.OfType<Grasshopper.Kernel.Special.GH_Group>())
      {
        ColorGroup(grp, null); // You decide if it should run once on all existing groups

      }
    }

    Print(msg.ToString());


    // Component setup
    Component.Description = "Set up event handlers to color groups based on prefixes such as 'in_' and 'out_'.\n"
      + "Please insert only swatcheds directly into the Colors input\n\n"
      + "MIT License. Copyright Mathias Sønderskov Schaltz 2022";
    Component.Params.Input[0].Description = "Please insert only swatcheds directly into the Colors input.\nRemember to rename them";
    Component.Params.Input[1].Description = "Toggle to run...";
    Component.Params.Input[2].Description = "Set to true if you want to automatically rename the groups and remove prefix. Default is false.";
    Component.Params.Input[3].Description = "Set to true to run it once and color all existing groups.";
    Component.Params.Input[Component.Params.Input.Count - 1].Description = "Set debug to true to get all the events printed in the rhino log";
# ---------- colorgroups: C# additional code ----------
  public static Random rnd = new Random();
  public int id = rnd.Next(0, 1000);
  StringBuilder msg = new StringBuilder();
  Dictionary<string, System.Drawing.Color> colorDict = new Dictionary<string, System.Drawing.Color>();

  bool _debug = false;
  bool _rename = false;

  public bool IdExists(int id)
  {
    IList<IGH_DocumentObject> objs = Grasshopper.Instances.ActiveCanvas.Document.Objects;
    return objs
      .OfType<IGH_Component>()
      .Where(ob => ob.NickName == this.Component.NickName)
      .Where(ob => ob.GetType().ToString() == "ScriptComponents.Component_CSNET_Script")
      .Where(ob => ob.Message == "id: " + id.ToString()).Any();

  }


  public void SetupDict()
  {
    colorDict.Clear();
    // Get all inputs to "Colors"
    IList<IGH_Param> colorSources = this.Component.Params.Input[0].Sources;
    if (colorSources.Count == 0)
    {
      throw new Exception("You forgot to setup the colors. Please input swatch components and rename them");
    }
    foreach(IGH_Param source in colorSources)
    {
      //if (source.Type.ToString() == "Grasshopper.Kernel.Types.GH_Colour")
      if (source is Grasshopper.Kernel.Special.GH_ColourSwatch)
      {
        string nickName = source.NickName.Split('_')[0].Trim() + "_";
        if(!colorDict.ContainsKey(nickName))
        {
          Grasshopper.Kernel.Special.GH_ColourSwatch swatch = (Grasshopper.Kernel.Special.GH_ColourSwatch) source;
          colorDict.Add(nickName, swatch.SwatchColour);
        }
        else
        {
          throw new Exception("Multiple swatches using the same name detected. Please rename");
        }
      }
      else
      {
        throw new Exception("Whacko! Why did you input a non-swatch into the Colors? " + source.Type.ToString());
      }

    }

    msg.AppendFormat("Set up the dictionaries with {0} colors\n", colorDict.Count);
    foreach(var pairs in colorDict)
    {
      msg.AppendFormat("{0} -> {1}\n", ("\"" + pairs.Key + "\"").PadRight(5 + colorDict.Keys.Select(k => k.Length).Max()), pairs.Value);
    }
  }

  public void SetEventHandlers()
  {

    // Always remove events first to avoid duplicates
    GrasshopperDocument.ObjectsAdded -= OnObjectsAdded;
    GrasshopperDocument.ObjectsDeleted -= OnObjectsRemoved;
    GrasshopperDocument.ObjectsDeleted -= OnDeleteThisComponent;

    // Attach events
    GrasshopperDocument.ObjectsAdded += OnObjectsAdded;
    GrasshopperDocument.ObjectsDeleted += OnObjectsRemoved;
    GrasshopperDocument.ObjectsDeleted += OnDeleteThisComponent;


    foreach(Grasshopper.Kernel.Special.GH_Group grp in GrasshopperDocument.Objects.OfType<Grasshopper.Kernel.Special.GH_Group>())
    {
      grp.ObjectChanged -= ColorGroup;
      grp.ObjectChanged += ColorGroup;

      //ColorGroup(grp, null); // Make sure to run it once
    }
    msg.AppendFormat("Added the eventhandlers on {0} existing groups and on future created groups\n", GrasshopperDocument.Objects.OfType<Grasshopper.Kernel.Special.GH_Group>().Count());
  }

  public void OnObjectsAdded(object sender, GH_DocObjectEventArgs e)
  {
    bool any = false;
    foreach (Grasshopper.Kernel.Special.GH_Group grp in e.Objects.OfType<Grasshopper.Kernel.Special.GH_Group>())
    {
      grp.ObjectChanged -= ColorGroup;
      grp.ObjectChanged += ColorGroup;
      any = true;
    }

    DebugWrite(any ? "Group Objects Added: Attaching Events to ObjectChanged" : "Objects Added - but no groups");
  }

  //Same but reversed
  public void OnObjectsRemoved(object sender, GH_DocObjectEventArgs e)
  {
    bool any = false;
    foreach (Grasshopper.Kernel.Special.GH_Group grp in e.Objects.OfType<Grasshopper.Kernel.Special.GH_Group>())
    {
      grp.ObjectChanged -= ColorGroup;
      any = true;
    }

    DebugWrite(any ? "Group Objects Removed, removing event" : "Objects Removed - although not a group");

  }



  public void RemoveEventHandlers()
  {
    GrasshopperDocument.ObjectsAdded -= OnObjectsAdded;
    GrasshopperDocument.ObjectsDeleted -= OnObjectsRemoved;


    foreach(Grasshopper.Kernel.Special.GH_Group grp in GrasshopperDocument.Objects.OfType<Grasshopper.Kernel.Special.GH_Group>())
    {
      grp.ObjectChanged -= ColorGroup;

    }
    msg.AppendFormat("Removed event handlers on document and on {0} groups\n", GrasshopperDocument.Objects.OfType<Grasshopper.Kernel.Special.GH_Group>().Count());

  }

  public void ColorGroup(object sender, EventArgs e)
  {
    if (!IdExists(id))
    {
      DebugWrite("Component not relevant. Disabling old id + " + id.ToString());
      RemoveEventHandlers();
      return;
    }

    Grasshopper.Kernel.Special.GH_Group grp = sender as Grasshopper.Kernel.Special.GH_Group;
    if (grp == null) return; //not type GH_Group
    //if (!grp.NickName.EndsWith("_")) return;

    string[] nameParts = grp.NickName.Split('_');
    if (nameParts.Length <= 1)
      return;
    string prefix = grp.NickName.Split('_')[0].Trim() + '_';

    string prefixes = String.Join(", ", colorDict.Keys.Select(k => "\"" + k + "\""));

    msg.Append("prefix " + prefix + "\n");
    if (colorDict.ContainsKey(prefix))
    {
      //if (grp.NickName.EndsWith("_"))
      grp.Colour = colorDict[prefix];
      if (_rename)
      {
        grp.NickName = grp.NickName.Replace(prefix, "");
      }

      DebugWrite("Colored " + grp.NickName);

    }
    else
    {
      DebugWrite("Group changed but not relevant: prefix " + prefix + " is not among " + prefixes);
    }

  }
  public void DebugWrite(string msg)
  {
    if (_debug)
    {
      Rhino.RhinoApp.WriteLine(String.Format("[ColGrps {0}]: {1}", id, msg));
    }
  }

  public void OnDeleteThisComponent(object sender, GH_DocObjectEventArgs e)
  {

    if (e.Objects.OfType<Grasshopper.Kernel.GH_Component>().Where(o => o.NickName == this.Component.NickName).Any())
    {
      DebugWrite("Removed template component. Removing all the eventhandlers");
      RemoveEventHandlers();
    }

  }
# ---------- end colorgroups ----------

fixparams = CSharpScript(FixOnce=button_2, Enable=toggle, Debug=Toggle(True))  # -> out; inputs FixOnce: Boolean, Enable: Boolean, Debug: Boolean
# ---------- fixparams: C# usings ----------
using System.Text;
using System.Linq;
using Grasshopper.Kernel.Special;
# ---------- fixparams: C# ----------
    _debug = Debug;
    _enable = Enable;
    msg.Clear();
    this.Component.Message = "id: " + id.ToString();




    if (Enable)
    {
      SetEventHandlers();
    }
    else
    {
      RemoveEventHandlers();
    }


    if (FixOnce)
    {
      FixAll();
    }

    Print(msg.ToString());

    // Component setup
    Component.Description = "Set up event handlers to change params to show nickname and not icon"
      + "\n\n"
      + "MIT License. Copyright Mathias Sønderskov Schaltz 2022";
    Component.Params.Input[0].Description = "Run me once on the document";
    Component.Params.Input[1].Description = "Toggle to enable event listener";
    Component.Params.Input[Component.Params.Input.Count - 1].Description = "Set debug to true to get all the events printed in the rhino log";
# ---------- fixparams: C# additional code ----------
  public static Random rnd = new Random();
  public int id = rnd.Next(0, 1000);
  StringBuilder msg = new StringBuilder();
  bool _debug = false;
  bool _enable = false;

  public Dictionary<IGH_ActiveObject, HashSet<GH_Group>> groupsPerObject = new Dictionary<IGH_ActiveObject, HashSet<GH_Group>>();


  public void OnObjectsAdded(object sender, GH_DocObjectEventArgs e)
  {
    if (!IdExists(id))
    {
      DebugWrite("[FixParam] Component not relevant. Disabling old id " + id.ToString());
      RemoveEventHandlers();
      return;
    }


    if(_enable)
    {
      foreach(IGH_Param par in e.Objects.OfType<IGH_Param>())
      {
        FixInputs(par);
      }
    }


  }

  public void FixAll()
  {
    //DebugWrite("Fixing all?");
    foreach(IGH_Param par in GrasshopperDocument.Objects.OfType<IGH_Param>())
    {

      FixInputs(par);
    }
  }




  public void FixInputs(IGH_ActiveObject obj)
  {



    IGH_Param par = obj as IGH_Param;
    if (par != null)
    {

      par.IconDisplayMode = GH_IconDisplayMode.name;


    }

  }


  public void SetEventHandlers()
  {

    GrasshopperDocument.ObjectsAdded -= OnObjectsAdded;
    GrasshopperDocument.ObjectsAdded += OnObjectsAdded;
    GrasshopperDocument.ObjectsDeleted -= OnDeleteThisComponent;
    GrasshopperDocument.ObjectsDeleted += OnDeleteThisComponent;
    msg.AppendFormat("Added the eventhandlers to OnObjectsAdded\n", GrasshopperDocument.Objects.OfType<Grasshopper.Kernel.Special.GH_Group>().Count());
  }

  public void RemoveEventHandlers()
  {
    GrasshopperDocument.ObjectsAdded -= OnObjectsAdded;
    GrasshopperDocument.ObjectsDeleted -= OnDeleteThisComponent;

    msg.AppendFormat("Removed wire event handlers on document\n", GrasshopperDocument.Objects.OfType<Grasshopper.Kernel.Special.GH_Group>().Count());

  }

  public void OnDeleteThisComponent(object sender, GH_DocObjectEventArgs e)
  {

    if (e.Objects.OfType<Grasshopper.Kernel.GH_Component>().Where(o => o.NickName == this.Component.NickName).Any())
    {
      DebugWrite("Removed template component. Removing all the eventhandlers");
      RemoveEventHandlers();
    }

  }

  public bool IdExists(int id)
  {
    IList<IGH_DocumentObject> objs = Grasshopper.Instances.ActiveCanvas.Document.Objects;
    return objs
      .OfType<IGH_Component>()
      .Where(ob => ob.NickName == this.Component.NickName)
      .Where(ob => ob.GetType().ToString() == "ScriptComponents.Component_CSNET_Script")
      .Where(ob => ob.Message == "id: " + id.ToString()).Any();

  }

  public void DebugWrite(string msg)
  {
    if (_debug)
    {
      Rhino.RhinoApp.WriteLine(String.Format("[FixParams {0}]: {1}", id, msg));
    }
  }
# ---------- end fixparams ----------

# ABxM Reciprocal Structures
fixwires = CSharpScript(FixOnce=button_3, Enable=toggle, Debug=Toggle(True))  # -> out; inputs FixOnce: Boolean, Enable: Boolean, Debug: Boolean
# ---------- fixwires: C# ----------
    _debug = Debug;
    _enable = Enable;
    msg.Clear();
    this.Component.Message = "id: " + id.ToString();


    SetDictionary();

    if (Enable)
    {
      SetEventHandlers();
    }
    else
    {
      RemoveEventHandlers();
    }


    if (FixOnce)
    {
      FixAll();
    }

    Print(msg.ToString());
    
    // Component setup
    Component.Description = "Set up event handlers to change all wire types across groups to faint"
      + "\n\n"
      + "MIT License. Copyright Mathias Sønderskov Schaltz 2022";
    Component.Params.Input[0].Description = "Run me once on the document";
    Component.Params.Input[1].Description = "Toggle to enable event listener";
    Component.Params.Input[Component.Params.Input.Count - 1].Description = "Set debug to true to get all the events printed in the rhino log";
# ---------- fixwires: C# additional code ----------
  public static Random rnd = new Random();
  public int id = rnd.Next(0, 1000);
  StringBuilder msg = new StringBuilder();
  bool _debug = false;
  bool _enable = false;

  public Dictionary<IGH_ActiveObject, HashSet<GH_Group>> groupsPerObject = new Dictionary<IGH_ActiveObject, HashSet<GH_Group>>();


  public void OnSolutionExpired(object sender, GH_DocUndoEventArgs e)
  {
    if(_enable)
      FixAll();
  }

  public void FixAll()
  {
    //DebugWrite("Fixing all?");
    foreach(IGH_ActiveObject key in groupsPerObject.Keys.Where(k => groupsPerObject[k].Count() > 0))
    {

      FixInputs(key);
    }
  }



  public bool HasGroup(IGH_ActiveObject obj)
  {
    return groupsPerObject[obj].Count > 0;
  }


  public void FixInputs(IGH_ActiveObject obj)
  {

    if (!IdExists(id))
    {
      DebugWrite("Component not relevant. Disabling old id " + id.ToString());
      RemoveEventHandlers();
      return;
    }

    //List<List<IGH_ActiveObject>> parents = new List<List<IGH_ActiveObject>>();
    IGH_Param par = obj as IGH_Param;
    if (par != null && par.Sources != null)
    {


      IEnumerable<IGH_ActiveObject> p = par.Sources.Select(s => s.Attributes.GetTopLevel.DocObject as IGH_ActiveObject);
      //parents.Add(p);
      if(HasGroup(obj) && p.All(o => !HasGroupsInCommon(o, obj)) && par.WireDisplay != GH_ParamWireDisplay.faint)
      {
        DebugWrite("Fixing " + par.Attributes.GetTopLevel.DocObject.NickName);
        par.WireDisplay = GH_ParamWireDisplay.faint;
      }

    }

    IGH_Component comp = obj as IGH_Component;
    if (comp != null)
    {
      foreach(IGH_Param inp in comp.Params.Input)
      {

        IEnumerable<IGH_ActiveObject> p = inp.Sources.Select(i => i.Attributes.GetTopLevel.DocObject as IGH_ActiveObject);

        if(HasGroup(obj) && p.All(o => !HasGroupsInCommon(o, obj)) && inp.WireDisplay != GH_ParamWireDisplay.faint)
        {
          DebugWrite("Fixing " + inp.Attributes.GetTopLevel.DocObject.NickName);
          inp.WireDisplay = GH_ParamWireDisplay.faint;
        }
      }

    }



  }





  public void SetDictionary()
  {
    IList<IGH_DocumentObject> objects = Grasshopper.Instances.ActiveCanvas.Document.Objects.ToList();
    //Print(String.Join(", ", objects.Select(o => o.NickName)));

    groupsPerObject = objects
      .Where(o => o.GetType() != typeof(GH_Group))
      .OfType<IGH_ActiveObject>()
      .ToDictionary(o => o, o => new HashSet<GH_Group>());

    foreach(GH_Group grp in objects.OfType<GH_Group>())
    {

      foreach(IGH_ActiveObject obj in grp.ObjectsRecursive().OfType<IGH_ActiveObject>())
      {
        groupsPerObject[obj].Add(grp);

      }
    }



  }

  public bool HasGroupsInCommon(IGH_ActiveObject obj1, IGH_ActiveObject obj2)
  {
    HashSet<GH_Group> set1 = groupsPerObject[obj1];
    HashSet<GH_Group> set2 = groupsPerObject[obj2];

    set1.IntersectWith(set2);

    return set1.Any();
  }

  public void SetEventHandlers()
  {

    GrasshopperDocument.UndoStateChanged -= OnSolutionExpired;
    GrasshopperDocument.UndoStateChanged += OnSolutionExpired;
    GrasshopperDocument.ObjectsDeleted -= OnDeleteThisComponent;
    GrasshopperDocument.ObjectsDeleted += OnDeleteThisComponent;
    msg.AppendFormat("Added the eventhandlers to UndoStateChanged\n", GrasshopperDocument.Objects.OfType<Grasshopper.Kernel.Special.GH_Group>().Count());
  }

  public void RemoveEventHandlers()
  {
    GrasshopperDocument.UndoStateChanged -= OnSolutionExpired;
    GrasshopperDocument.ObjectsDeleted -= OnDeleteThisComponent;

    msg.AppendFormat("Removed wire event handlers on document\n", GrasshopperDocument.Objects.OfType<Grasshopper.Kernel.Special.GH_Group>().Count());

  }

  public void OnDeleteThisComponent(object sender, GH_DocObjectEventArgs e)
  {

    if (e.Objects.OfType<Grasshopper.Kernel.GH_Component>().Where(o => o.NickName == this.Component.NickName).Any())
    {
      DebugWrite("Removed template component. Removing all the eventhandlers");
      RemoveEventHandlers();
    }

  }

  public bool IdExists(int id)
  {
    IList<IGH_DocumentObject> objs = Grasshopper.Instances.ActiveCanvas.Document.Objects;
    return objs
      .OfType<IGH_Component>()
      .Where(ob => ob.NickName == this.Component.NickName)
      .Where(ob => ob.GetType().ToString() == "ScriptComponents.Component_CSNET_Script")
      .Where(ob => ob.Message == "id: " + id.ToString()).Any();

  }

  public void DebugWrite(string msg)
  {
    if (_debug)
    {
      Rhino.RhinoApp.WriteLine(String.Format("[FixWire {0}]: {1}", id, msg));
    }
  }
# ---------- end fixwires ----------

# ---- group: LAYOUT / LAYOUT SETTINGS
sizex = Slider(3, range=1..10)
sizey = Slider(5, range=1..10)
divisionx = Slider(2, range=2..10)
divisiony = Slider(2, range=2..10)
engagementx = Slider(0.5, range=0..0.5)
engagementx_2 = Slider(0.5, range=0..0.5)

# ---- group: LAYOUT
rectangularlayout = RectangularLayout(sizex=sizex, sizey=sizey, divisionsx=divisionx, divisionsy=divisiony, engagementx=engagementx_2, engagementy=engagementx)  # -> rectangle_3, membersy_2, membersx_2, supernodes_2
supernodes = Point(rectangularlayout.supernodes_2)
membersx = Curve(rectangularlayout.membersx_2)
membersy = Curve(rectangularlayout.membersy_2)
rectangle = Curve(rectangularlayout.rectangle_3)

# ----
curve = Curve(flatten([membersy, membersx]))
list_length = ListLength(List=curve)

# ---- group: STOCK / STOCK SETTINGS
maxlength = Slider(3, range=0.1..3)
number = Number(list_length)
stockfactor = Slider(1.2, range=1..2)
anchor = Point(Point(0.3286059796, -3.482917903, 0))
minlength = Slider(2.2, range=0.1..3)

# ----
# Behavioural Fabrication
# ICD - Seminar WiSe 2024/2025
# 
# Final Submission
# 
# Jonas Mertens
# Likhinya Kvs
update = Button()

# ---- group: STOCK
randomstock = RandomStock(minlength=minlength, maxlength=maxlength, count=number, stockfactor=stockfactor, anchor=anchor)  # -> stock_2, lengths_2
stock = Curve(randomstock.stock_2)
lengths = Number(randomstock.lengths_2)

# ---- group: VISUALISATION
curve_2 = Curve([membersy, membersx, rectangle])
custom_preview = CustomPreview(Geometry=curve_2, Material=ColourSwatch(SwatchColor=RGB(128, 128, 128)))

# ----
python = GhPythonScript(update=update)  # inputs update: Boolean
# ---------- python: Python ----------
# Seghier Mohamed Abdelaziz - 2021 - seghierdesign@gmail.com

import Grasshopper as gh

ghDoc = ghenv.Component.OnPingDocument()
objects = ghDoc.Objects

object = []

for obj in objects: 

    if obj.NickName.Length == 0:
        if str(obj.RemovedFromDocument.DeclaringType) == "Grasshopper.Kernel.GH_Component":
            object.append(obj)
                
if update == True:
    gh.Kernel.GH_Document.NewSolution(ghDoc,False)
    for o in object:
        gh.Kernel.GH_Document.RemoveObject(ghDoc ,o,False)
# ---------- end python ----------

# ---- group: INITIALIZE MEMBER LENGTHS
membercount = Number(list_length)
stocklengths = Number(lengths)
list_length_2 = ListLength(List=stocklengths)
subtraction = Subtraction(A=list_length_2, B=membercount)
random_reduce = RandomReduce(List=stocklengths, Reduction=subtraction, Seed=1)
memberlengths = Number(random_reduce)

# ----
rectangle_2 = Curve(rectangle)
membersy_2 = Curve(membersy)
membersx_2 = Curve(membersx)
merge = Merge(Data1=membersy_2, Data2=membersx_2)  # -> flatten(Result)

# ---- group: CUSTOM DATA
end_points = EndPoints(Curve=merge)  # -> Start, End
vector_2pt = Vector2Pt(PointA=end_points.Start, PointB=end_points.End, Unitize=True)  # -> Vector, Length
memberlengths_2 = Number(memberlengths)
vector = Vector(vector_2pt.Vector)
dict = CSharpScript(
    K="length",
    V=memberlengths_2,
    Reference="C:\Users\Likhinya\AppData\Roaming\McNeel\Rhinoceros\packages\7.0\ABxM-Core\1.5.6\ABxM.Core.dll")  # -> D; inputs K: String, V: list
# ---------- dict: C# ----------
    List<Dictionary<string, object>> customData = new List<Dictionary<string, object>>();

    foreach(object myValue in V)
    {
      Dictionary<string, object> myData = new Dictionary<string, object>();
      myData.Add(K, myValue);
      customData.Add(myData);
    }


    D = customData;
# ---------- dict: C# additional code ----------
  /// <summary>
  /// This method will be called once every solution, before any calls to RunScript.
  /// </summary>
  public override void BeforeRunScript()
  { }
  /// <summary>
  /// This method will be called once every solution, after any calls to RunScript.
  /// </summary>
  public override void AfterRunScript()
  { }
# ---------- end dict ----------
dict_2 = CSharpScript(
    K="direction",
    V=vector,
    Reference="C:\USERS\LIKHINYA\APPDATA\ROAMING\MCNEEL\RHINOCEROS\PACKAGES\7.0\ABXM-CORE\1.5.6\ABxM.Core.dll")  # -> D; inputs K: String, V: list; same code as dict
entwine = Entwine(Branch00=dict_2, Branch01=dict, FlattenInputs=True)  # -> simplify(Result)
cluster = Cluster(D=entwine)

# ---- group: START POSITIONS
curve_middle = CurveMiddle(Curve=reparameterize(merge))
startpositions = Point(curve_middle)

# ----
# Cohesion
python_2 = GhPythonScript(iWeight=Slider(1, range=0.01..1))  # -> out, oBehavior
# ---------- python_2: Python ----------
import Rhino.Geometry as rg
import clr
clr.AddReference("ABxM.Core")
import ABxM.Core as abm


class CohesionBehavior(abm.Behavior.BehaviorBase):
    def __init__(self, weight):
        self.Weight = weight
    
    def Execute(self, agent):
        boid = agent
        desired_velocity = rg.Vector3d(0,0,0)
        nodeNeighbors = 0 # will be a list

        for i, agent in enumerate(boid.AgentSystem.Agents):
            # find left member in supernode
            vector = agent.Position - boid.Position
            directedVector = boid.CustomData['direction'] * vector * boid.CustomData['direction']
            cross_product = directedVector.X * vector.Y - directedVector.Y * vector.X 
            if cross_product > 0 and boid.CustomData['direction'] * agent.CustomData['direction'] == 0.0:
                nodeNeighbors = i
            else:
                pass

        neighborAgent = boid.AgentSystem.Agents[nodeNeighbors]

        vector = neighborAgent.Position - boid.Position
        directedVector = neighborAgent.CustomData['direction'] * vector * neighborAgent.CustomData['direction']
        desired_velocity += (directedVector.Length - neighborAgent.CustomData['length']/2) * directedVector

        desired_velocity.Unitize()
        desired_velocity *= boid.AgentSystem.MaxSpeed
            
        steering = desired_velocity - boid.Velocity
        
        boid.AddForce(steering * self.Weight)

behavior = CohesionBehavior(iWeight)
oBehavior = behavior
# ---------- end python_2 ----------

# ---- group: ASSEMBLE AS
define_single_brep_environment = DefineSingleBrepEnvironment(Brep=rectangle_2)  # -> BrepEnvironment, SurfaceCurvatures
define_boid = DefineBoid(Positions=startpositions, Behaviors=python_2.oBehavior, CustomData=cluster)
define_boid_system = DefineBoidSystem(
    SurfaceEnvironment=define_single_brep_environment.BrepEnvironment,
    BoidAgents=define_boid,
    DisplacementThreshold="0.001",
    Timestep=0.02,
    MaxForce=3,
    MaxSpeed=2)

# ---- group: SOLVER / RUN SIM
button_4 = Button()
toggle_4 = BooleanToggle(True)

# ---- group: SOLVER
data = Data(define_boid_system)
solver = StepByStepSolver(Reset=button_4, Execute=toggle_4, AgentSystems=data)  # -> DisplayGeometries, AllAgentSystems, IterationCount
ticks = Panel(solver.IterationCount)

# ----
python_3 = GhPythonScript(x=solver.AllAgentSystems)  # -> out, p, d, l
# ---------- python_3: Python ----------
lengths = []
directions = []
positions = []

if x:
    for agent in x.Agents:
        position = agent.Position
        positions.append(position)
        length = agent.CustomData['length']
        lengths.append(length)
        direction = agent.CustomData['direction']
        directions.append(direction)

p = positions
l = lengths
d = directions
# ---------- end python_3 ----------

# ---- group: VISUALIZE AGENT SYSTEM
negative = Negative(Value=python_3.l)
amplitude = Amplitude(Vector=python_3.d, Amplitude=expr("x/2", negative))
line_sdl = LineSDL(Start=python_3.p, Direction=python_3.d, Length=python_3.l)
move = Move(Geometry=line_sdl, Motion=amplitude)  # -> Geometry, Transform
curve_3 = Curve(move.Geometry)
point = Point()

# ---- group: VISUALIZE AGENT SYSTEM / VISUALIZATION
custom_preview_2 = CustomPreview(Geometry=[curve_3, point], Material=ColourSwatch(SwatchColor=RGB(255, 136, 0)))

# ==== cluster RectangularLayout
engagementy = ClusterInput()
sizex = ClusterInput()
sizey = ClusterInput()
divisionsx = ClusterInput()
divisionsy = ClusterInput()
engagementx = ClusterInput()
engagementy_2 = Number(engagementy)
sizex_2 = Number(sizex)
sizey_2 = Number(sizey)
divisionsx_2 = Number(divisionsx)
divisionsy_2 = Number(divisionsy)
engagementx_2 = Number(engagementx)

construct_domain = ConstructDomain(DomainStart=0, DomainEnd=sizex_2)
construct_domain_2 = ConstructDomain(DomainStart=0, DomainEnd=sizey_2)
xy_plane = XYPlane(Origin=Point(0, 0, 0))
series = Series(Start=expr("1/x", divisionsx_2), Step=expr("1/x", divisionsx_2), Count=expr("x-1", divisionsx_2))
series_2 = Series(Start=expr("1/x", divisionsy_2), Step=expr("1/x", divisionsy_2), Count=expr("x-1", divisionsy_2))
rectangle = Rectangle(Plane=xy_plane, XSize=construct_domain, YSize=construct_domain_2, Radius=0)  # -> Rectangle, Length
construct_point = ConstructPoint(XCoordinate=series, YCoordinate=0, ZCoordinate=0)
construct_point_2 = ConstructPoint(XCoordinate=0, YCoordinate=series_2, ZCoordinate=0)
iso_curve = IsoCurve(Surface=reparameterize(rectangle.Rectangle), UVPoint=construct_point)  # -> UIsocurve, VIsocurve
iso_curve_2 = IsoCurve(Surface=reparameterize(rectangle.Rectangle), UVPoint=construct_point_2)  # -> UIsocurve, VIsocurve

curve = Curve(iso_curve_2.UIsocurve)
curve_2 = Curve(iso_curve.VIsocurve)

curve_curve = CurveCurve(CurveA=simplify(curve), CurveB=flatten(curve_2))  # -> Points, ParamsA, ParamsB
curve_curve_2 = CurveCurve(CurveA=simplify(curve_2), CurveB=flatten(curve))  # -> Points, ParamsA, ParamsB
shift_paths = ShiftPaths(Data=curve_curve.ParamsA, Offset=-1)
shift_paths_2 = ShiftPaths(Data=curve_curve_2.ParamsA, Offset=-1)
shatter = Shatter(Curve=curve, Parameters=shift_paths)  # -> simplify(Segments)
shatter_2 = Shatter(Curve=curve_2, Parameters=shift_paths_2)  # -> simplify(Segments)

curve_3 = Curve(shatter_2)
number = Number(divisionsx_2)
number_2 = Number(engagementx_2)
curve_4 = Curve(shatter)
number_3 = Number(divisionsy_2)
number_4 = Number(engagementy_2)

deconstruct_plane = DeconstructPlane(Plane=xy_plane)  # -> Origin, XAxis, YAxis, ZAxis
list_length = ListLength(List=curve_4)
expression = Expression(x=number_3, e=number_4, Expression="1/x * e")
list_length_2 = ListLength(List=curve_3)
expression_2 = Expression(x=number, e=number_2, Expression="1/x * e")
panel = Panel("""1
-1""")
panel_2 = Panel("""-1
1""")
repeat_data = RepeatData(Data=panel, Length=list_length)  # -> simplify(Data)
repeat_data_2 = RepeatData(Data=panel_2, Length=list_length_2)  # -> simplify(Data)
split_tree = SplitTree(Data=repeat_data_2, Masks=flatten("{0,2,...}"))  # -> Positive, Negative
split_tree_2 = SplitTree(Data=repeat_data, Masks=flatten("{0,2,...}"))  # -> Positive, Negative
negative = Negative(Value=split_tree.Negative)
negative_2 = Negative(Value=split_tree_2.Negative)
merge = Merge(Data1=split_tree.Positive, Data2=negative)
merge_2 = Merge(Data1=split_tree_2.Positive, Data2=negative_2)
multiplication = Multiplication(A=deconstruct_plane.XAxis, B=merge, C=expression_2)
multiplication_2 = Multiplication(A=deconstruct_plane.YAxis, B=merge_2, C=expression)
move = Move(Geometry=curve_3, Motion=multiplication)  # -> Geometry, Transform
move_2 = Move(Geometry=curve_4, Motion=multiplication_2)  # -> Geometry, Transform
extend_curve = ExtendCurve(Curve=move.Geometry, Type=0, Start=expression, End=expression)
extend_curve_2 = ExtendCurve(Curve=move_2.Geometry, Type=0, Start=expression_2, End=expression_2)

supernodes = Point(flatten(curve_curve_2.Points))
membersx = Curve(extend_curve_2)
membersy = Curve(extend_curve)
rectangle_2 = Curve(rectangle.Rectangle)
rectangle_3 = ClusterOutput(rectangle_2)
membersy_2 = ClusterOutput(membersy)
membersx_2 = ClusterOutput(membersx)
supernodes_2 = ClusterOutput(supernodes)

# ==== cluster RandomStock
minlength = ClusterInput()
maxlength = ClusterInput()
count = ClusterInput()
stockfactor = ClusterInput()
anchor = ClusterInput()
minlength_2 = Number(minlength)
maxlength_2 = Number(maxlength)
count_2 = Number(count)
stockfactor_2 = Number(stockfactor)
anchor_2 = Point(anchor)

construct_domain = ConstructDomain(DomainStart=minlength_2, DomainEnd=maxlength_2)
multiplication = Multiplication(A=count_2, B=stockfactor_2)
deconstruct = Deconstruct(Point=anchor_2)  # -> XComponent, YComponent, ZComponent
unit_y = UnitY(Factor=1)
random = Random(Range=construct_domain, Number=multiplication, Seed=2)
series = Series(Start=deconstruct.XComponent, Step="0.2", Count=multiplication)
construct_point = ConstructPoint(XCoordinate=series, YCoordinate=deconstruct.YComponent, ZCoordinate=deconstruct.ZComponent)
line_sdl = LineSDL(Start=construct_point, Direction=unit_y, Length=random)

stock = Curve(line_sdl)
lengths = Number(random)
stock_2 = ClusterOutput(stock)
lengths_2 = ClusterOutput(lengths)

# ==== cluster Cluster
D = ClusterInput()
flip = FlipMatrix(Data=D)
c_script = CSharpScript(
    Dictionaries=flip,
    Reference="C:\USERS\LIKHINYA\APPDATA\ROAMING\MCNEEL\RHINOCEROS\PACKAGES\7.0\ABXM-CORE\1.5.6\ABxM.Core.dll")  # -> CustomData; inputs Dictionaries: tree
# ---------- c_script: C# usings ----------
using ABxM.Core.Agent;
# ---------- c_script: C# ----------
    List<Dictionary<string, object>> customData = new List<Dictionary<string, object>>();


    for (int i = 0; i < Dictionaries.BranchCount; i++)
    {
      Dictionary<string, object> myData = new Dictionary<string, object>();

      for (int j = 0; j < Dictionaries.Branch(i).Count; j++)
      {
        Dictionary < string, object > dict = Dictionaries.Branch(i)[j] as Dictionary < string, object >;

        string key = null;
        object val = null;
        foreach( KeyValuePair<string, object> kvp in dict )
          myData.Add(kvp.Key, kvp.Value);

      }
      customData.Add(myData);
    }


    CustomData = customData;
# ---------- c_script: C# additional code ----------
  /// <summary>
  /// This method will be called once every solution, before any calls to RunScript.
  /// </summary>
  public override void BeforeRunScript()
  { }
  /// <summary>
  /// This method will be called once every solution, after any calls to RunScript.
  /// </summary>
  public override void AfterRunScript()
  { }
# ---------- end c_script ----------
customdata = ClusterOutput(c_script)
