# Grasshopper definition 03_assignment1_ABMS_LK_JM_11-11.gh (Grasshopper 1.0.7)
# plug-ins: ABxM.Grasshopper

# ---- group: Template
od_outdated = ColourSwatch(SwatchColor=RGBA(97, 97, 97, 150))
u_updated = ColourSwatch(SwatchColor=RGBA(208, 115, 230, 112))
o_outputs = ColourSwatch(SwatchColor=RGBA(160, 218, 242, 203))
toggle = BooleanToggle(True)
s_settings = ColourSwatch(SwatchColor=RGBA(224, 145, 81, 154))
g_general = ColourSwatch(SwatchColor=RGBA(245, 243, 237, 156))
y_yellow = ColourSwatch(SwatchColor=RGBA(247, 244, 64, 188))
i_inputs = ColourSwatch(SwatchColor=RGBA(125, 217, 98, 150))
c_core = ColourSwatch(SwatchColor=RGBA(235, 227, 206, 203))
r_red = ColourSwatch(SwatchColor=RGBA(242, 63, 63, 203))

change_background_color = Button()
toggle_2 = BooleanToggle(True)
button = Button()
button_2 = Button()
button_3 = Button()
changebackground = GhPythonScript(
    change=change_background_color,
    newBackgroundColor=ColourSwatch(SwatchColor=RGB(255, 255, 255)),
    wireColor=RGB(110, 110, 110),
    selectedWireColor=RGB(47, 255, 0))  # inputs newBackgroundColor: Color, wireColor: Color, selectedWireColor: Color
# ---------- changebackground: Python ----------
import Grasshopper as gh
import rhinoscriptsyntax as rs

newShadeColor = rs.CreateColor(0,0,0,20)
newEdgeColor = rs.CreateColor(0,0,0,40)

if(change):
     gh.GUI.Canvas.GH_Skin.canvas_back = newBackgroundColor
     gh.GUI.Canvas.GH_Skin.canvas_shade = newShadeColor
     gh.GUI.Canvas.GH_Skin.canvas_edge = newEdgeColor
     gh.GUI.Canvas.GH_Skin.wire_default = wireColor
     gh.GUI.Canvas.GH_Skin.wire_selected_a = selectedWireColor
     gh.GUI.Canvas.GH_Skin.wire_selected_b = selectedWireColor
# ---------- end changebackground ----------

# Do not modify this
# component without setting
# enable to false first!
toggle_3 = BooleanToggle(True)
colorgroups = CSharpScript(
    Colors=[i_inputs, s_settings, g_general, c_core, o_outputs, r_red, y_yellow, u_updated, od_outdated],
    Enable=toggle,
    Rename=toggle_2,
    RunOnce=button,
    Debug=toggle_3)  # -> out; inputs Colors: list of Color, Enable: Boolean, Rename: Boolean, RunOnce: Boolean, Debug: Boolean
# ---------- colorgroups: C# usings ----------
using System.Linq;
using System.Text;
using System.Reflection;
# ---------- colorgroups: C# ----------
    msg.Clear();


    this.Component.Message = "id: " + id.ToString();

    _debug = Debug; //Set to true to have all events printed in rhino log
    _rename = Rename;

    if (Enable)
    {
      msg.AppendFormat("Set up events on ID {0}\n", id);
      SetupDict(); // Create a dictionary of the input swatches
      SetEventHandlers(); // This would do the job.


    }
    else
    {
      RemoveEventHandlers();
    }
    if (RunOnce)
    {
      foreach(Grasshopper.Kernel.Special.GH_Group grp in Grasshopper.Instances.ActiveCanvas.Document.Objects.OfType<Grasshopper.Kernel.Special.GH_Group>())
      {
        ColorGroup(grp, null); // You decide if it should run once on all existing groups

      }
    }

    Print(msg.ToString());


    // Component setup
    Component.Description = "Set up event handlers to color groups based on prefixes such as 'in_' and 'out_'.\n"
      + "Please insert only swatcheds directly into the Colors input\n\n"
      + "MIT License. Copyright Mathias Sønderskov Schaltz 2022";
    Component.Params.Input[0].Description = "Please insert only swatcheds directly into the Colors input.\nRemember to rename them";
    Component.Params.Input[1].Description = "Toggle to run...";
    Component.Params.Input[2].Description = "Set to true if you want to automatically rename the groups and remove prefix. Default is false.";
    Component.Params.Input[3].Description = "Set to true to run it once and color all existing groups.";
    Component.Params.Input[Component.Params.Input.Count - 1].Description = "Set debug to true to get all the events printed in the rhino log";
# ---------- colorgroups: C# additional code ----------
  public static Random rnd = new Random();
  public int id = rnd.Next(0, 1000);
  StringBuilder msg = new StringBuilder();
  Dictionary<string, System.Drawing.Color> colorDict = new Dictionary<string, System.Drawing.Color>();

  bool _debug = false;
  bool _rename = false;

  public bool IdExists(int id)
  {
    IList<IGH_DocumentObject> objs = Grasshopper.Instances.ActiveCanvas.Document.Objects;
    return objs
      .OfType<IGH_Component>()
      .Where(ob => ob.NickName == this.Component.NickName)
      .Where(ob => ob.GetType().ToString() == "ScriptComponents.Component_CSNET_Script")
      .Where(ob => ob.Message == "id: " + id.ToString()).Any();

  }


  public void SetupDict()
  {
    colorDict.Clear();
    // Get all inputs to "Colors"
    IList<IGH_Param> colorSources = this.Component.Params.Input[0].Sources;
    if (colorSources.Count == 0)
    {
      throw new Exception("You forgot to setup the colors. Please input swatch components and rename them");
    }
    foreach(IGH_Param source in colorSources)
    {
      //if (source.Type.ToString() == "Grasshopper.Kernel.Types.GH_Colour")
      if (source is Grasshopper.Kernel.Special.GH_ColourSwatch)
      {
        string nickName = source.NickName.Split('_')[0].Trim() + "_";
        if(!colorDict.ContainsKey(nickName))
        {
          Grasshopper.Kernel.Special.GH_ColourSwatch swatch = (Grasshopper.Kernel.Special.GH_ColourSwatch) source;
          colorDict.Add(nickName, swatch.SwatchColour);
        }
        else
        {
          throw new Exception("Multiple swatches using the same name detected. Please rename");
        }
      }
      else
      {
        throw new Exception("Whacko! Why did you input a non-swatch into the Colors? " + source.Type.ToString());
      }

    }

    msg.AppendFormat("Set up the dictionaries with {0} colors\n", colorDict.Count);
    foreach(var pairs in colorDict)
    {
      msg.AppendFormat("{0} -> {1}\n", ("\"" + pairs.Key + "\"").PadRight(5 + colorDict.Keys.Select(k => k.Length).Max()), pairs.Value);
    }
  }

  public void SetEventHandlers()
  {

    // Always remove events first to avoid duplicates
    GrasshopperDocument.ObjectsAdded -= OnObjectsAdded;
    GrasshopperDocument.ObjectsDeleted -= OnObjectsRemoved;
    GrasshopperDocument.ObjectsDeleted -= OnDeleteThisComponent;

    // Attach events
    GrasshopperDocument.ObjectsAdded += OnObjectsAdded;
    GrasshopperDocument.ObjectsDeleted += OnObjectsRemoved;
    GrasshopperDocument.ObjectsDeleted += OnDeleteThisComponent;


    foreach(Grasshopper.Kernel.Special.GH_Group grp in GrasshopperDocument.Objects.OfType<Grasshopper.Kernel.Special.GH_Group>())
    {
      grp.ObjectChanged -= ColorGroup;
      grp.ObjectChanged += ColorGroup;

      //ColorGroup(grp, null); // Make sure to run it once
    }
    msg.AppendFormat("Added the eventhandlers on {0} existing groups and on future created groups\n", GrasshopperDocument.Objects.OfType<Grasshopper.Kernel.Special.GH_Group>().Count());
  }

  public void OnObjectsAdded(object sender, GH_DocObjectEventArgs e)
  {
    bool any = false;
    foreach (Grasshopper.Kernel.Special.GH_Group grp in e.Objects.OfType<Grasshopper.Kernel.Special.GH_Group>())
    {
      grp.ObjectChanged -= ColorGroup;
      grp.ObjectChanged += ColorGroup;
      any = true;
    }

    DebugWrite(any ? "Group Objects Added: Attaching Events to ObjectChanged" : "Objects Added - but no groups");
  }

  //Same but reversed
  public void OnObjectsRemoved(object sender, GH_DocObjectEventArgs e)
  {
    bool any = false;
    foreach (Grasshopper.Kernel.Special.GH_Group grp in e.Objects.OfType<Grasshopper.Kernel.Special.GH_Group>())
    {
      grp.ObjectChanged -= ColorGroup;
      any = true;
    }

    DebugWrite(any ? "Group Objects Removed, removing event" : "Objects Removed - although not a group");

  }



  public void RemoveEventHandlers()
  {
    GrasshopperDocument.ObjectsAdded -= OnObjectsAdded;
    GrasshopperDocument.ObjectsDeleted -= OnObjectsRemoved;


    foreach(Grasshopper.Kernel.Special.GH_Group grp in GrasshopperDocument.Objects.OfType<Grasshopper.Kernel.Special.GH_Group>())
    {
      grp.ObjectChanged -= ColorGroup;

    }
    msg.AppendFormat("Removed event handlers on document and on {0} groups\n", GrasshopperDocument.Objects.OfType<Grasshopper.Kernel.Special.GH_Group>().Count());

  }

  public void ColorGroup(object sender, EventArgs e)
  {
    if (!IdExists(id))
    {
      DebugWrite("Component not relevant. Disabling old id + " + id.ToString());
      RemoveEventHandlers();
      return;
    }

    Grasshopper.Kernel.Special.GH_Group grp = sender as Grasshopper.Kernel.Special.GH_Group;
    if (grp == null) return; //not type GH_Group
    //if (!grp.NickName.EndsWith("_")) return;

    string[] nameParts = grp.NickName.Split('_');
    if (nameParts.Length <= 1)
      return;
    string prefix = grp.NickName.Split('_')[0].Trim() + '_';

    string prefixes = String.Join(", ", colorDict.Keys.Select(k => "\"" + k + "\""));

    msg.Append("prefix " + prefix + "\n");
    if (colorDict.ContainsKey(prefix))
    {
      //if (grp.NickName.EndsWith("_"))
      grp.Colour = colorDict[prefix];
      if (_rename)
      {
        grp.NickName = grp.NickName.Replace(prefix, "");
      }

      DebugWrite("Colored " + grp.NickName);

    }
    else
    {
      DebugWrite("Group changed but not relevant: prefix " + prefix + " is not among " + prefixes);
    }

  }
  public void DebugWrite(string msg)
  {
    if (_debug)
    {
      Rhino.RhinoApp.WriteLine(String.Format("[ColGrps {0}]: {1}", id, msg));
    }
  }

  public void OnDeleteThisComponent(object sender, GH_DocObjectEventArgs e)
  {

    if (e.Objects.OfType<Grasshopper.Kernel.GH_Component>().Where(o => o.NickName == this.Component.NickName).Any())
    {
      DebugWrite("Removed template component. Removing all the eventhandlers");
      RemoveEventHandlers();
    }

  }
# ---------- end colorgroups ----------

fixparams = CSharpScript(FixOnce=button_2, Enable=toggle, Debug=Toggle(True))  # -> out; inputs FixOnce: Boolean, Enable: Boolean, Debug: Boolean
# ---------- fixparams: C# usings ----------
using System.Text;
using System.Linq;
using Grasshopper.Kernel.Special;
# ---------- fixparams: C# ----------
    _debug = Debug;
    _enable = Enable;
    msg.Clear();
    this.Component.Message = "id: " + id.ToString();




    if (Enable)
    {
      SetEventHandlers();
    }
    else
    {
      RemoveEventHandlers();
    }


    if (FixOnce)
    {
      FixAll();
    }

    Print(msg.ToString());

    // Component setup
    Component.Description = "Set up event handlers to change params to show nickname and not icon"
      + "\n\n"
      + "MIT License. Copyright Mathias Sønderskov Schaltz 2022";
    Component.Params.Input[0].Description = "Run me once on the document";
    Component.Params.Input[1].Description = "Toggle to enable event listener";
    Component.Params.Input[Component.Params.Input.Count - 1].Description = "Set debug to true to get all the events printed in the rhino log";
# ---------- fixparams: C# additional code ----------
  public static Random rnd = new Random();
  public int id = rnd.Next(0, 1000);
  StringBuilder msg = new StringBuilder();
  bool _debug = false;
  bool _enable = false;

  public Dictionary<IGH_ActiveObject, HashSet<GH_Group>> groupsPerObject = new Dictionary<IGH_ActiveObject, HashSet<GH_Group>>();


  public void OnObjectsAdded(object sender, GH_DocObjectEventArgs e)
  {
    if (!IdExists(id))
    {
      DebugWrite("[FixParam] Component not relevant. Disabling old id " + id.ToString());
      RemoveEventHandlers();
      return;
    }


    if(_enable)
    {
      foreach(IGH_Param par in e.Objects.OfType<IGH_Param>())
      {
        FixInputs(par);
      }
    }


  }

  public void FixAll()
  {
    //DebugWrite("Fixing all?");
    foreach(IGH_Param par in GrasshopperDocument.Objects.OfType<IGH_Param>())
    {

      FixInputs(par);
    }
  }




  public void FixInputs(IGH_ActiveObject obj)
  {



    IGH_Param par = obj as IGH_Param;
    if (par != null)
    {

      par.IconDisplayMode = GH_IconDisplayMode.name;


    }

  }


  public void SetEventHandlers()
  {

    GrasshopperDocument.ObjectsAdded -= OnObjectsAdded;
    GrasshopperDocument.ObjectsAdded += OnObjectsAdded;
    GrasshopperDocument.ObjectsDeleted -= OnDeleteThisComponent;
    GrasshopperDocument.ObjectsDeleted += OnDeleteThisComponent;
    msg.AppendFormat("Added the eventhandlers to OnObjectsAdded\n", GrasshopperDocument.Objects.OfType<Grasshopper.Kernel.Special.GH_Group>().Count());
  }

  public void RemoveEventHandlers()
  {
    GrasshopperDocument.ObjectsAdded -= OnObjectsAdded;
    GrasshopperDocument.ObjectsDeleted -= OnDeleteThisComponent;

    msg.AppendFormat("Removed wire event handlers on document\n", GrasshopperDocument.Objects.OfType<Grasshopper.Kernel.Special.GH_Group>().Count());

  }

  public void OnDeleteThisComponent(object sender, GH_DocObjectEventArgs e)
  {

    if (e.Objects.OfType<Grasshopper.Kernel.GH_Component>().Where(o => o.NickName == this.Component.NickName).Any())
    {
      DebugWrite("Removed template component. Removing all the eventhandlers");
      RemoveEventHandlers();
    }

  }

  public bool IdExists(int id)
  {
    IList<IGH_DocumentObject> objs = Grasshopper.Instances.ActiveCanvas.Document.Objects;
    return objs
      .OfType<IGH_Component>()
      .Where(ob => ob.NickName == this.Component.NickName)
      .Where(ob => ob.GetType().ToString() == "ScriptComponents.Component_CSNET_Script")
      .Where(ob => ob.Message == "id: " + id.ToString()).Any();

  }

  public void DebugWrite(string msg)
  {
    if (_debug)
    {
      Rhino.RhinoApp.WriteLine(String.Format("[FixParams {0}]: {1}", id, msg));
    }
  }
# ---------- end fixparams ----------

# ABxM Reciprocal Structures
fixwires = CSharpScript(FixOnce=button_3, Enable=toggle, Debug=Toggle(True))  # -> out; inputs FixOnce: Boolean, Enable: Boolean, Debug: Boolean
# ---------- fixwires: C# ----------
    _debug = Debug;
    _enable = Enable;
    msg.Clear();
    this.Component.Message = "id: " + id.ToString();


    SetDictionary();

    if (Enable)
    {
      SetEventHandlers();
    }
    else
    {
      RemoveEventHandlers();
    }


    if (FixOnce)
    {
      FixAll();
    }

    Print(msg.ToString());
    
    // Component setup
    Component.Description = "Set up event handlers to change all wire types across groups to faint"
      + "\n\n"
      + "MIT License. Copyright Mathias Sønderskov Schaltz 2022";
    Component.Params.Input[0].Description = "Run me once on the document";
    Component.Params.Input[1].Description = "Toggle to enable event listener";
    Component.Params.Input[Component.Params.Input.Count - 1].Description = "Set debug to true to get all the events printed in the rhino log";
# ---------- fixwires: C# additional code ----------
  public static Random rnd = new Random();
  public int id = rnd.Next(0, 1000);
  StringBuilder msg = new StringBuilder();
  bool _debug = false;
  bool _enable = false;

  public Dictionary<IGH_ActiveObject, HashSet<GH_Group>> groupsPerObject = new Dictionary<IGH_ActiveObject, HashSet<GH_Group>>();


  public void OnSolutionExpired(object sender, GH_DocUndoEventArgs e)
  {
    if(_enable)
      FixAll();
  }

  public void FixAll()
  {
    //DebugWrite("Fixing all?");
    foreach(IGH_ActiveObject key in groupsPerObject.Keys.Where(k => groupsPerObject[k].Count() > 0))
    {

      FixInputs(key);
    }
  }



  public bool HasGroup(IGH_ActiveObject obj)
  {
    return groupsPerObject[obj].Count > 0;
  }


  public void FixInputs(IGH_ActiveObject obj)
  {

    if (!IdExists(id))
    {
      DebugWrite("Component not relevant. Disabling old id " + id.ToString());
      RemoveEventHandlers();
      return;
    }

    //List<List<IGH_ActiveObject>> parents = new List<List<IGH_ActiveObject>>();
    IGH_Param par = obj as IGH_Param;
    if (par != null && par.Sources != null)
    {


      IEnumerable<IGH_ActiveObject> p = par.Sources.Select(s => s.Attributes.GetTopLevel.DocObject as IGH_ActiveObject);
      //parents.Add(p);
      if(HasGroup(obj) && p.All(o => !HasGroupsInCommon(o, obj)) && par.WireDisplay != GH_ParamWireDisplay.faint)
      {
        DebugWrite("Fixing " + par.Attributes.GetTopLevel.DocObject.NickName);
        par.WireDisplay = GH_ParamWireDisplay.faint;
      }

    }

    IGH_Component comp = obj as IGH_Component;
    if (comp != null)
    {
      foreach(IGH_Param inp in comp.Params.Input)
      {

        IEnumerable<IGH_ActiveObject> p = inp.Sources.Select(i => i.Attributes.GetTopLevel.DocObject as IGH_ActiveObject);

        if(HasGroup(obj) && p.All(o => !HasGroupsInCommon(o, obj)) && inp.WireDisplay != GH_ParamWireDisplay.faint)
        {
          DebugWrite("Fixing " + inp.Attributes.GetTopLevel.DocObject.NickName);
          inp.WireDisplay = GH_ParamWireDisplay.faint;
        }
      }

    }



  }





  public void SetDictionary()
  {
    IList<IGH_DocumentObject> objects = Grasshopper.Instances.ActiveCanvas.Document.Objects.ToList();
    //Print(String.Join(", ", objects.Select(o => o.NickName)));

    groupsPerObject = objects
      .Where(o => o.GetType() != typeof(GH_Group))
      .OfType<IGH_ActiveObject>()
      .ToDictionary(o => o, o => new HashSet<GH_Group>());

    foreach(GH_Group grp in objects.OfType<GH_Group>())
    {

      foreach(IGH_ActiveObject obj in grp.ObjectsRecursive().OfType<IGH_ActiveObject>())
      {
        groupsPerObject[obj].Add(grp);

      }
    }



  }

  public bool HasGroupsInCommon(IGH_ActiveObject obj1, IGH_ActiveObject obj2)
  {
    HashSet<GH_Group> set1 = groupsPerObject[obj1];
    HashSet<GH_Group> set2 = groupsPerObject[obj2];

    set1.IntersectWith(set2);

    return set1.Any();
  }

  public void SetEventHandlers()
  {

    GrasshopperDocument.UndoStateChanged -= OnSolutionExpired;
    GrasshopperDocument.UndoStateChanged += OnSolutionExpired;
    GrasshopperDocument.ObjectsDeleted -= OnDeleteThisComponent;
    GrasshopperDocument.ObjectsDeleted += OnDeleteThisComponent;
    msg.AppendFormat("Added the eventhandlers to UndoStateChanged\n", GrasshopperDocument.Objects.OfType<Grasshopper.Kernel.Special.GH_Group>().Count());
  }

  public void RemoveEventHandlers()
  {
    GrasshopperDocument.UndoStateChanged -= OnSolutionExpired;
    GrasshopperDocument.ObjectsDeleted -= OnDeleteThisComponent;

    msg.AppendFormat("Removed wire event handlers on document\n", GrasshopperDocument.Objects.OfType<Grasshopper.Kernel.Special.GH_Group>().Count());

  }

  public void OnDeleteThisComponent(object sender, GH_DocObjectEventArgs e)
  {

    if (e.Objects.OfType<Grasshopper.Kernel.GH_Component>().Where(o => o.NickName == this.Component.NickName).Any())
    {
      DebugWrite("Removed template component. Removing all the eventhandlers");
      RemoveEventHandlers();
    }

  }

  public bool IdExists(int id)
  {
    IList<IGH_DocumentObject> objs = Grasshopper.Instances.ActiveCanvas.Document.Objects;
    return objs
      .OfType<IGH_Component>()
      .Where(ob => ob.NickName == this.Component.NickName)
      .Where(ob => ob.GetType().ToString() == "ScriptComponents.Component_CSNET_Script")
      .Where(ob => ob.Message == "id: " + id.ToString()).Any();

  }

  public void DebugWrite(string msg)
  {
    if (_debug)
    {
      Rhino.RhinoApp.WriteLine(String.Format("[FixWire {0}]: {1}", id, msg));
    }
  }
# ---------- end fixwires ----------

# ---- group: Members / inputs
no_of_members = Slider(4, range=1..10)
sizex = Slider(5, range=1..10)
sizey = Slider(10, range=1..10)

# ---- group: Members
xy = XYPlane(Origin=Point(0, 0, 0))
rectangle = Rectangle(Plane=xy, XSize=sizex, YSize=sizey, Radius=0)  # -> Rectangle, Length
random = Random(Range=Domain(-1, 1), Number=no_of_members, Seed=2)
random_2 = Random(Range=Domain(-1, 1), Number=no_of_members, Seed=3)
random_3 = Random(Range=Domain(1, 1), Number=no_of_members, Seed=3)
pop2d = Populate2D(Region=rectangle.Rectangle, Count=no_of_members, Seed=2)
vec = VectorXYZ(XComponent=random, YComponent=random_2, ZComponent=0)  # -> Vector, Length
line = LineSDL(Start=pop2d, Direction=vec.Vector, Length=random_3)
line_2 = Line(line)

# ----
curve = Curve(flatten(line_2))
list_length = ListLength(List=curve)

# ---- group: STOCK / STOCK SETTINGS
maxlength = Slider(2.4, range=0.1..3)
number = Number(list_length)
stockfactor = Slider(1.2, range=1..2)
anchor = Point(Point(0.3286059796, -3.482917903, 0))
minlength = Slider(0.5, range=0.1..3)

# ----
# Behavioural Fabrication
# ICD - Seminar WiSe 2024/2025
# 
# Final Submission
# 
# Jonas Mertens
# Likhinya Kvs
update = Button()

# ---- group: STOCK
randomstock = RandomStock(minlength=minlength, maxlength=maxlength, count=number, stockfactor=stockfactor, anchor=anchor)  # -> stock_2, lengths_2
stock = Curve(randomstock.stock_2)
lengths = Number(randomstock.lengths_2)

# ---- group: VISUALISATION
curve_2 = Curve(line_2)
custom_preview = CustomPreview(Geometry=curve_2, Material=ColourSwatch(SwatchColor=RGB(128, 128, 128)))

# ----
python = GhPythonScript(update=update)  # inputs update: Boolean
# ---------- python: Python ----------
# Seghier Mohamed Abdelaziz - 2021 - seghierdesign@gmail.com

import Grasshopper as gh

ghDoc = ghenv.Component.OnPingDocument()
objects = ghDoc.Objects

object = []

for obj in objects: 

    if obj.NickName.Length == 0:
        if str(obj.RemovedFromDocument.DeclaringType) == "Grasshopper.Kernel.GH_Component":
            object.append(obj)
                
if update == True:
    gh.Kernel.GH_Document.NewSolution(ghDoc,False)
    for o in object:
        gh.Kernel.GH_Document.RemoveObject(ghDoc ,o,False)
# ---------- end python ----------

# ---- group: INITIALIZE MEMBER LENGTHS
membercount = Number(list_length)
stocklengths = Number(lengths)
list_length_2 = ListLength(List=stocklengths)
subtraction = Subtraction(A=list_length_2, B=membercount)
random_reduce = RandomReduce(List=stocklengths, Reduction=subtraction, Seed=1)
memberlengths = Number(random_reduce)

# ---- group: CUSTOM DATA
line_3 = Line(line_2)
engagementdistance = Number(Slider(0.1, range=0..1))
end_points = EndPoints(Curve=graft(line_3))  # -> simplify(Start), simplify(End)
python_2 = GhPythonScript(iStart=end_points.Start, iEnd=end_points.End)  # -> out, oNamesA, oNamesB; inputs iStart: tree, iEnd: tree
# ---------- python_2: Python ----------
import Grasshopper as gh

# Get the paths of the input data tree
startPaths = iStart.Paths
endPaths = iEnd.Paths

# Convert each path to a string representation
stringsStart = [str(path).strip("{}") + "A"  for path in startPaths]
stringsEnd = [str(path).strip("{}") + "B" for path in endPaths]

# Output the list of path strings
oNamesA = stringsStart
oNamesB = stringsEnd
# ---------- end python_2 ----------
length = Length(Curve=line_3)
list_length_3 = ListLength(List=line_3)
keyword_for_no_docking = Panel("empty")
repeat_data = RepeatData(Data=engagementdistance, Length=expr("x*2", list_length_3))
repeat_data_2 = RepeatData(Data=keyword_for_no_docking, Length=expr("x*2", list_length_3))
merge = Merge(Data1=python_2.oNamesA, Data2=python_2.oNamesB)
merge_2 = Merge(Data1=python_2.oNamesB, Data2=python_2.oNamesA)
merge_3 = Merge(Data1=length, Data2=length)
engagementdistance_2 = Number(repeat_data)
dockingagent = Text(repeat_data_2)
partnername = Text(merge_2)
agentname = Text(merge)
distance = Number(merge_3)
dict = CSharpScript(
    K="name",
    V=agentname,
    Reference="C:\USERS\LIKHINYA\APPDATA\ROAMING\MCNEEL\RHINOCEROS\PACKAGES\7.0\ABXM-CORE\1.5.6\ABxM.Core.dll")  # -> D; inputs K: String, V: list
# ---------- dict: C# ----------
    List<Dictionary<string, object>> customData = new List<Dictionary<string, object>>();

    foreach(object myValue in V)
    {
      Dictionary<string, object> myData = new Dictionary<string, object>();
      myData.Add(K, myValue);
      customData.Add(myData);
    }


    D = customData;
# ---------- dict: C# additional code ----------
  /// <summary>
  /// This method will be called once every solution, before any calls to RunScript.
  /// </summary>
  public override void BeforeRunScript()
  { }
  /// <summary>
  /// This method will be called once every solution, after any calls to RunScript.
  /// </summary>
  public override void AfterRunScript()
  { }
# ---------- end dict ----------
dict_2 = CSharpScript(
    K="partner",
    V=partnername,
    Reference="C:\USERS\LIKHINYA\APPDATA\ROAMING\MCNEEL\RHINOCEROS\PACKAGES\7.0\ABXM-CORE\1.5.6\ABxM.Core.dll")  # -> D; inputs K: String, V: list; same code as dict
dict_3 = CSharpScript(
    K="distance",
    V=distance,
    Reference="C:\USERS\LIKHINYA\APPDATA\ROAMING\MCNEEL\RHINOCEROS\PACKAGES\7.0\ABXM-CORE\1.5.6\ABxM.Core.dll")  # -> D; inputs K: String, V: list; same code as dict
dict_4 = CSharpScript(
    K="e",
    V=engagementdistance_2,
    Reference="C:\USERS\LIKHINYA\APPDATA\ROAMING\MCNEEL\RHINOCEROS\PACKAGES\7.0\ABXM-CORE\1.5.6\ABxM.Core.dll")  # -> D; inputs K: String, V: list; same code as dict
dict_5 = CSharpScript(
    K="docking",
    V=dockingagent,
    Reference="C:\USERS\LIKHINYA\APPDATA\ROAMING\MCNEEL\RHINOCEROS\PACKAGES\7.0\ABXM-CORE\1.5.6\ABxM.Core.dll")  # -> D; inputs K: String, V: list; same code as dict
entwine = Entwine(Branch00=dict, Branch01=dict_2, Branch02=dict_3, Branch03=dict_4, Branch04=dict_5, FlattenInputs=True)  # -> simplify(Result)
cluster = Cluster(D=entwine)
customdata = Data(cluster)

# ---- group: START POSITIONS
end_points_2 = EndPoints(Curve=line_3)  # -> Start, End
merge_4 = Merge(Data1=end_points_2.Start, Data2=end_points_2.End)
startpositions = Point(merge_4)

# ----
panel = Panel(merge)
panel_2 = Panel(merge_2)
number_slider = Slider(0.1, range=0..1)
lng = ListLength(List=line_3)
stopbehavior = GhPythonScript(iWeight=number_slider, iAgNumber=lng)  # -> out, oBehavior; inputs iAgNumber: Int32
# ---------- stopbehavior: Python ----------
import Rhino
import Rhino.Geometry as rg
import clr
clr.AddReference("ABxM.Core")
import ABxM.Core as abm
import random
import math

from System.Collections.Generic import List


class StopBehaviour(abm.Behavior.BehaviorBase):
    def __init__(self, weight, agnumber):
        self.Weight = weight
        self.AgNumber = agnumber

    def Execute(self, agent):
        cartesianAgent = agent
        system = cartesianAgent.AgentSystem
        
        docked_count = 0
        for agent in system.Agents:
            if agent.CustomData['docking'] != 'empty':
                docked_count+=1
            else: pass
            
        if sum >= self.AgNumber:
            self.Solver.CancelExecution()  # Stops the solver from running

behavior = StopBehaviour(iWeight,iAgNumber)
oBehavior = behavior
# ---------- end stopbehavior ----------
wander = GhPythonScript(iWeight=Slider(1, range=0..1), iStep=Slider(0.01, range=0.01..1))  # -> out, oBehavior
# ---------- wander: Python ----------
__author__ = "Likhinya"
__version__ = "2024.11.10"


import Rhino
import Rhino.Geometry as rg
import clr
clr.AddReference("ABxM.Core")
import ABxM.Core as abm
import random
import math

from System.Collections.Generic import List


class CartWander(abm.Behavior.BehaviorBase):
    def __init__(self, weight, step):
        self.Weight = weight
        self.Step = step
    
    def Execute(self, agent):
        
        cartesianAgent = agent
        system = cartesianAgent.AgentSystem

        if cartesianAgent.CustomData['name'][1] == 'A':            
            randAngle= random.random() * math.pi
            wanderMove = self.Step * rg.Vector3d.XAxis
            wanderMove.Rotate(randAngle, rg.Vector3d.ZAxis)
            cartesianAgent.AddMove(wanderMove, 'Wander')
            cartesianAgent.Weights.Add(self.Weight)
        
        else: return
                

behavior = CartWander(iWeight, iStep)
oBehavior = behavior
# ---------- end wander ----------
partner_cohesion = GhPythonScript(iWeight=Slider(1, range=0..1))  # -> out, oBehavior
# ---------- partner_cohesion: Python ----------
__author__ = "Likhinya"
__version__ = "2024.11.10"


import Rhino
import Rhino.Geometry as rg
import clr
clr.AddReference("ABxM.Core")
import ABxM.Core as abm

from System.Collections.Generic import List


class CartPartnerCohesion(abm.Behavior.BehaviorBase):
    def __init__(self, weight):
        self.Weight = weight
    
    def Execute(self, agent):
        
        cartesianAgent = agent
        system = cartesianAgent.AgentSystem

        if cartesianAgent.CustomData['name'][1] == 'B':
            for neighbor in cartesianAgent.AgentSystem.Agents:
                if neighbor.CustomData['name'][0] == cartesianAgent.CustomData['name'][0]:
                    #Rhino.RhinoApp.WriteLine(neighbor.CustomData['name']+cartesianAgent.CustomData['name'])
                    moveToDistance = cartesianAgent.Position - neighbor.Position
                    moveToDistance.Unitize()
                    moveToDistance = (neighbor.Position + neighbor.CustomData['distance'] * moveToDistance) - cartesianAgent.Position
                    cartesianAgent.Moves.Add(moveToDistance)
                    cartesianAgent.Weights.Add(self.Weight)
                
                else: pass
        
        else: return
                

behavior = CartPartnerCohesion(iWeight)
oBehavior = behavior
# ---------- end partner_cohesion ----------
stopbehavior_2 = GhPythonScript(iWeight=number_slider)  # -> out, oBehavior
# ---------- stopbehavior_2: Python ----------
import Rhino
import Rhino.Geometry as rg
import clr
clr.AddReference("ABxM.Core")
import ABxM.Core as abm
import random
import math

from System.Collections.Generic import List


class StopBehaviour(abm.Behavior.BehaviorBase):
    def __init__(self, weight):
        self.Weight = weight

    def Execute(self, agent):
        cartesianAgent = agent
        system = cartesianAgent.AgentSystem
        
        if not (agent.CustomData['docking']== 'empty'):
            self.Solver.CancelExecution()  # Stops the solver from running

behavior = StopBehaviour(iWeight)
oBehavior = behavior
# ---------- end stopbehavior_2 ----------
docking = GhPythonScript(iWeight=Slider(1, range=0..1), iRadius=Slider(3.8, range=0.1..10), iDistance=Slider(0.4, range=0.01..0.5))  # -> out, oBehavior
# ---------- docking: Python ----------
import Rhino
import Rhino.Geometry as rg
import clr
clr.AddReference("ABxM.Core")
import ABxM.Core as abm
import random
import math

from System.Collections.Generic import List


class CartAttract(abm.Behavior.BehaviorBase):
    def __init__(self, weight, radius, distance):
        self.Weight = weight
        self.Radius = radius
        self.Distance = distance
    
    def Execute(self, agent):
        
        cartesianAgent = agent
        system = cartesianAgent.AgentSystem

        if cartesianAgent.CustomData['name'][1] == 'A' and cartesianAgent.CustomData['docking'] == 'empty':
            neighbors = system.FindNeighbors(cartesianAgent, self.Radius)
            
            if(neighbors.Count == 0): return

            anchors = []
            for neighbor in neighbors:
                if neighbor.CustomData['name'][0] != cartesianAgent.CustomData['name'][0]\
                 and neighbor.CustomData['name'][1] == 'B' and neighbor.CustomData['docking'] == 'empty':
                        #Rhino.RhinoApp.WriteLine(neighbor.CustomData['name'])
                        anchors.append(neighbor)
                        
                else: pass

            if(len(anchors) > 0): 
                closestAnchor = min(anchors, key=lambda anchor: (cartesianAgent.Position - anchor.Position).Length)
                # find partner of anchor
                memberDirection = rg.Vector3d(0.0, 0.0, 0.0)
                memberDocking = "empty"
                for agent in system.Agents:
                    if agent.CustomData['name'][0] == closestAnchor.CustomData['name'][0]\
                        and agent.CustomData['name'][1] != closestAnchor.CustomData['name'][1]:
                        memberDirection = agent.Position - closestAnchor.Position
                        memberDirection.Unitize()
                        memberDocking = agent.CustomData['docking'][0]
    
                    else:
                        pass
                anchorPosition = closestAnchor.Position + closestAnchor.CustomData['e'] * memberDirection
                # check distance of agent to anchor
                anchorVector = cartesianAgent.Position - anchorPosition
                anchorDistance = anchorVector.Length
                if anchorDistance < self.Distance and cartesianAgent.CustomData['name'][0] != memberDocking:
                    Rhino.RhinoApp.WriteLine(cartesianAgent.CustomData['name'] + memberDocking)
                    cartesianAgent.NewCustomData['docking'] = closestAnchor.CustomData['name']
                    closestAnchor.NewCustomData['docking'] = cartesianAgent.CustomData['name']
                else: pass
        
        # undock if falsly connected (only undocks one side...WIP)
        elif cartesianAgent.CustomData['name'][1] == 'A' and cartesianAgent.CustomData['docking'] != 'empty':
            # find partner of docked agent
            for agent in system.Agents:
                if agent.CustomData['name'][0] == cartesianAgent.CustomData['docking'][0] and agent.CustomData['name'][1] == 'A'\
                 and agent.CustomData['docking'][0] == cartesianAgent.CustomData['name'][0]\
                  and int(agent.CustomData['name'][0]) < int(cartesianAgent.CustomData['name'][0]):
                  agent.NewCustomData['docking'] = 'empty'
                else: pass
        
        else: return
                

behavior = CartAttract(iWeight, iRadius, iDistance)
oBehavior = behavior
# ---------- end docking ----------
attraction = GhPythonScript(iWeight=Slider(1, range=0..1), iRadius=Slider(10, range=0.1..10), iStep=Slider(0.1, range=0.01..1))  # -> out, oBehavior
# ---------- attraction: Python ----------
import Rhino
import Rhino.Geometry as rg
import clr
clr.AddReference("ABxM.Core")
import ABxM.Core as abm
import random
import math

from System.Collections.Generic import List


class CartAttract(abm.Behavior.BehaviorBase):
    def __init__(self, weight, radius, step):
        self.Weight = weight
        self.Radius = radius
        self.Step = step
    
    def Execute(self, agent):
        
        cartesianAgent = agent
        system = cartesianAgent.AgentSystem

        if cartesianAgent.CustomData['name'][1] == 'A' and cartesianAgent.CustomData['docking'] == 'empty':
            neighbors = system.FindNeighbors(cartesianAgent, self.Radius)
            
            if(neighbors.Count == 0): return

            anchors = []
            for neighbor in neighbors:
                if neighbor.CustomData['name'][0] != cartesianAgent.CustomData['name'][0]\
                 and neighbor.CustomData['name'][1] == 'B'\
                 and neighbor.CustomData['docking'] == 'empty':
                        #Rhino.RhinoApp.WriteLine(neighbor.CustomData['name'])
                        anchors.append(neighbor)
                        
                else: pass

            if len(anchors) > 0:
                closestAnchor = min(anchors, key=lambda anchor: (cartesianAgent.Position - anchor.Position).Length)
                # find partner of anchor
                memberDirection = rg.Vector3d(0.0, 0.0, 0.0)
                for agent in system.Agents:
                    if agent.CustomData['name'][0] == closestAnchor.CustomData['name'][0]\
                     and agent.CustomData['name'][1] != closestAnchor.CustomData['name'][1]:
                        memberDirection = agent.Position - closestAnchor.Position
                        memberDirection.Unitize()
                    else:
                        pass

                moveTowards = closestAnchor.Position + closestAnchor.CustomData['e'] * memberDirection - cartesianAgent.Position
                length = moveTowards.Length
                moveTowards.Unitize()
                moveTowards = (self.Step * (0.1 + length) * moveTowards)
                cartesianAgent.AddMove(moveTowards, 'Attraction')
                cartesianAgent.Weights.Add(self.Weight)

        elif cartesianAgent.CustomData['name'][1] == 'A' and cartesianAgent.CustomData['docking'] != 'empty':
            neighbors = system.FindNeighbors(cartesianAgent, self.Radius)
            
            if(neighbors.Count == 0): return

            for neighbor in neighbors:
                if neighbor.CustomData['name'] == cartesianAgent.CustomData['docking']:
                        Rhino.RhinoApp.WriteLine(neighbor.CustomData['name'])
                        memberDirection = rg.Vector3d(0.0, 0.0, 0.0)
                        for agent in system.Agents:
                            if agent.CustomData['name'][0] == neighbor.CustomData['name'][0]\
                             and agent.CustomData['name'][1] != neighbor.CustomData['name'][1]:
                                memberDirection = agent.Position - neighbor.Position
                                memberDirection.Unitize()
                            else:
                                pass
                        
                        moveTowards = neighbor.Position + neighbor.CustomData['e'] * memberDirection - cartesianAgent.Position
                        length = moveTowards.Length
                        moveTowards.Unitize()
                        moveTowards = (self.Step * (0.1 + length) * moveTowards)
                        cartesianAgent.AddMove(moveTowards, 'Attraction')
                        cartesianAgent.Weights.Add(self.Weight)
                        
                else: pass

        else: return
                

behavior = CartAttract(iWeight, iRadius, iStep)
oBehavior = behavior
# ---------- end attraction ----------
data = Data([partner_cohesion.oBehavior, wander.oBehavior, attraction.oBehavior, docking.oBehavior])
define_cartesian_agent = DefineCartesianAgent(Positions=startpositions, Behaviors=data, CustomData=customdata)
define_cartesian_agent_system = DefineCartesianAgentSystem(CartesianAgents=define_cartesian_agent, ComputeDiagram=0)
python_3 = GhPythonScript(iAgents=define_cartesian_agent)  # -> out, oAgentSystem; inputs iAgents: list
# ---------- python_3: Python ----------
import Rhino
import Rhino.Geometry as rg
import clr
clr.AddReference("ABxM.Core")
import ABxM.Core as abm

from System.Collections.Generic import List


class NewCartesianSystem(abm.AgentSystem.CartesianAgentSystem):
    def Execute(self):
        docked_count = 0
        for agent in self.Agents:
            if agent.CustomData['docking'] != 'empty':
                docked_count+=1
            else: pass
            
        if docked_count >= (len(self.Agents)-2):
            self.Solver.CancelExecution()
        
agents = List[abm.Agent.CartesianAgent](iAgents)
AgentSystem = NewCartesianSystem(agents,iCE)
oAgentSystem = AgentSystem
# ---------- end python_3 ----------

# ---- group: SOLVER / RUN SIM
button_4 = Button()
toggle_4 = BooleanToggle(False)

# ---- group: SOLVER
data_2 = Data(define_cartesian_agent_system)
solver = StepByStepSolver(Reset=button_4, Execute=toggle_4, AgentSystems=data_2)  # -> DisplayGeometries, AllAgentSystems, IterationCount
ticks = Panel(solver.IterationCount)

# ----
python_4 = GhPythonScript(iAS=solver.AllAgentSystems)  # -> out, oA, oB, oDockingA, oDockingB, oNames
# ---------- python_4: Python ----------
positionsA = []
positionsB = []
dockingA = []
dockingB = []
names = []

if iAS:
    for agent in iAS.Agents:
        position = agent.Position
        names.append(agent.CustomData['name'])
        if agent.CustomData['name'][1] == 'A':
            positionsA.append(position)
            dockingA.append(agent.CustomData['docking'])
        else:
            positionsB.append(position)
            dockingB.append(agent.CustomData['docking'])

oA = positionsA
oB = positionsB
oDockingA = dockingA
oDockingB = dockingB
oNames = names
# ---------- end python_4 ----------
panel_3 = Panel(python_4.oNames)
panel_4 = Panel(python_4.oDockingA)
panel_5 = Panel(python_4.oDockingB)
positionsa = Point(python_4.oA)
positionsb = Point(python_4.oB)
line_4 = Line(StartPoint=positionsa, EndPoint=positionsb)
merge_5 = Merge(Data1=positionsa, Data2=positionsb)

# ---- group: VISUALIZATION
colour_swatch = ColourSwatch(SwatchColor=RGB(255, 136, 0))
custom_preview_2 = CustomPreview(Geometry=line_4, Material=colour_swatch)

# ----
text_tag = TextTag(Location=merge_5, Text=python_4.oNames, Colour=colour_swatch)

# ==== cluster RandomStock
minlength = ClusterInput()
maxlength = ClusterInput()
count = ClusterInput()
stockfactor = ClusterInput()
anchor = ClusterInput()
minlength_2 = Number(minlength)
maxlength_2 = Number(maxlength)
count_2 = Number(count)
stockfactor_2 = Number(stockfactor)
anchor_2 = Point(anchor)

construct_domain = ConstructDomain(DomainStart=minlength_2, DomainEnd=maxlength_2)
multiplication = Multiplication(A=count_2, B=stockfactor_2)
deconstruct = Deconstruct(Point=anchor_2)  # -> XComponent, YComponent, ZComponent
unit_y = UnitY(Factor=1)
random = Random(Range=construct_domain, Number=multiplication, Seed=2)
series = Series(Start=deconstruct.XComponent, Step="0.2", Count=multiplication)
construct_point = ConstructPoint(XCoordinate=series, YCoordinate=deconstruct.YComponent, ZCoordinate=deconstruct.ZComponent)
line_sdl = LineSDL(Start=construct_point, Direction=unit_y, Length=random)

stock = Curve(line_sdl)
lengths = Number(random)
stock_2 = ClusterOutput(stock)
lengths_2 = ClusterOutput(lengths)

# ==== cluster Cluster
D = ClusterInput()
flip = FlipMatrix(Data=D)
c_script = CSharpScript(
    Dictionaries=flip,
    Reference="C:\Users\Likhinya\AppData\Roaming\McNeel\Rhinoceros\packages\7.0\ABxM-Core\1.5.6\ABxM.Core.dll")  # -> CustomData; inputs Dictionaries: tree
# ---------- c_script: C# usings ----------
using ABxM.Core.Agent;
# ---------- c_script: C# ----------
    List<Dictionary<string, object>> customData = new List<Dictionary<string, object>>();


    for (int i = 0; i < Dictionaries.BranchCount; i++)
    {
      Dictionary<string, object> myData = new Dictionary<string, object>();

      for (int j = 0; j < Dictionaries.Branch(i).Count; j++)
      {
        Dictionary < string, object > dict = Dictionaries.Branch(i)[j] as Dictionary < string, object >;

        string key = null;
        object val = null;
        foreach( KeyValuePair<string, object> kvp in dict )
          myData.Add(kvp.Key, kvp.Value);

      }
      customData.Add(myData);
    }


    CustomData = customData;
# ---------- c_script: C# additional code ----------
  /// <summary>
  /// This method will be called once every solution, before any calls to RunScript.
  /// </summary>
  public override void BeforeRunScript()
  { }
  /// <summary>
  /// This method will be called once every solution, after any calls to RunScript.
  /// </summary>
  public override void AfterRunScript()
  { }
# ---------- end c_script ----------
customdata = ClusterOutput(c_script)
