# Grasshopper definition assignment1_ABMS_submission_JM_LK.gh (Grasshopper 1.0.8)
# plug-ins: RhinoCodePluginGH, ABxM.Grasshopper

# ---- group: ENVIRONMENT / ENVIRONMENT SETTINGS
# Computational Design and Simulation
# - Assignment 01 ABMS
# students: Jonas Mertens, Likhinya Kvs
sizex = Slider(4, range=1..10)
sizey = Slider(4, range=1..10)
no_of_members = Slider(4, range=1..10)
seed = Slider(2, range=0..20)

# ---- group: AGENT SYSTEM / CUSTOM DATA / AGENT SETTINGS
engagementdistance = Slider(0.7, range=0..1)

# ---- group: AGENT SYSTEM / BEHAVIORS / WANDER SETTINGS
iweight = Slider(0, range=0..1)
istep = Slider(0.01, range=0.01..1)

# ---- group: AGENT SYSTEM / BEHAVIORS / COHESION SETTINGS
iweight_2 = Slider(1, range=0..1)

# ---- group: AGENT SYSTEM / BEHAVIORS / ATTRACTION SETTINGS
iweight_3 = Slider(1, range=0..1)
iradius = Slider(6, range=0.1..10)
istep_2 = Slider(0.07, range=0.01..1)

# ---- group: AGENT SYSTEM / BEHAVIORS / DOCKING SETTINGS
iweight_4 = Slider(1, range=0..1)
iradius_2 = Slider(4.9, range=0.1..10)
idistance = Slider(0.1, range=0.01..0.5)

# ---- group: AGENT SYSTEM / BEHAVIORS / Docking
python_3_script = Python3Script(iWeight=iweight_4, iRadius=iradius_2, iDistance=idistance)  # -> out, oBehavior
# ---------- python_3_script: Python ----------
"""
Computational Design and Simulation
assignment 01 - ABMS
students: Jonas Mertens, Likhinya Kvs
"""

import Rhino.Geometry as rg  # Import Rhino's geometry library for vector manipulation
import clr
clr.AddReference("ABxM.Core")  # Reference ABxM.Core for agent behavior management
import ABxM.Core as abm
import math

# Define a custom behavior for docking among agents
class CartDocking(abm.Behavior.BehaviorBase):
    def __init__(self, weight, radius, distance):
        """Initialize CartDocking behavior with specified weight, radius, and docking distance."""
        self.Weight = weight
        self.Radius = radius
        self.Distance = distance
    
    def Execute(self, agent):
        """Execute the docking behavior for agents based on proximity and docking status."""
        
        cartesianAgent = agent
        system = cartesianAgent.AgentSystem

        # If agent type is 'A' and currently undocked
        if cartesianAgent.CustomData['name'][1] == 'A' and cartesianAgent.CustomData['docking'] == 'empty':
            # Find nearby agents within the specified radius
            neighbors = system.FindNeighbors(cartesianAgent, self.Radius)
            if neighbors.Count == 0:
                return

            anchors = []
            # Identify eligible neighbors as potential docking anchors
            for neighbor in neighbors:
                if (neighbor.CustomData['name'][0] != cartesianAgent.CustomData['name'][0]
                    and neighbor.CustomData['name'][1] == 'B'
                    and neighbor.CustomData['docking'] == 'empty'):
                        anchors.append(neighbor)

            # If eligible anchors are found, select the closest one
            if anchors:
                closestAnchor = min(anchors, key=lambda anchor: (cartesianAgent.Position - anchor.Position).Length)
                
                # Find the partner of the closest anchor and calculate direction
                memberDirection = rg.Vector3d(0.0, 0.0, 0.0)
                memberDocking = "empty"
                for agent in system.Agents:
                    if (agent.CustomData['name'][0] == closestAnchor.CustomData['name'][0]
                        and agent.CustomData['name'][1] != closestAnchor.CustomData['name'][1]):
                        memberDirection = agent.Position - closestAnchor.Position
                        memberDirection.Unitize()
                        memberDocking = agent.CustomData['docking'][0]

                # Calculate anchor's intended position based on partner direction
                anchorPosition = closestAnchor.Position + closestAnchor.CustomData['e'] * memberDirection
                
                # Check if agent is within docking distance to anchor
                anchorVector = cartesianAgent.Position - anchorPosition
                anchorDistance = anchorVector.Length
                if anchorDistance < self.Distance and cartesianAgent.CustomData['name'][0] != memberDocking:
                    # Establish docking relationship if within range and valid
                    cartesianAgent.NewCustomData['docking'] = closestAnchor.CustomData['name']
                    closestAnchor.NewCustomData['docking'] = cartesianAgent.CustomData['name']

        # Undock if docking conditions are invalid
        elif cartesianAgent.CustomData['name'][1] == 'A' and cartesianAgent.CustomData['docking'] != 'empty':
            # Find partner of the docked agent
            for agent in system.Agents:
                if (agent.CustomData['name'][0] == cartesianAgent.CustomData['docking'][0]
                    and agent.CustomData['name'][1] == 'A'):
                    # Check if undocking criteria are met
                    if (agent.CustomData['docking'][0] == int(cartesianAgent.CustomData['name'][0]) 
                        and int(agent.CustomData['name'][0] < cartesianAgent.CustomData['name'][0])):
                        # Locate docking agent to undock
                        for anchor in system.Agents:
                            if anchor.CustomData['name'] == cartesianAgent.CustomData['docking']:
                                cartesianAgent.NewCustomData['docking'] = "empty"
                                anchor.NewCustomData['docking'] = "empty"

        else:
            return  # No action if criteria are not met

# Instantiate CartDocking behavior with provided weight, radius, and docking distance inputs
behavior = CartDocking(iWeight, iRadius, iDistance)
oBehavior = behavior
# ---------- end python_3_script ----------

# ---- group: AGENT SYSTEM / BEHAVIORS / Wander
python_3_script_2 = Python3Script(iWeight=iweight, iStep=istep)  # -> out, oBehavior
# ---------- python_3_script_2: Python ----------
"""
Computational Design and Simulation
assignment 01 - ABMS
students: Jonas Mertens, Likhinya Kvs
"""

import Rhino.Geometry as rg  # Import Rhino's geometry library for vector and rotation operations
import clr
clr.AddReference("ABxM.Core")  # Add a reference to ABxM.Core library
import ABxM.Core as abm  # Import ABxM.Core as abm for agent behavior management
import random
import math

# Define a custom behavior for a wandering movement in a cartesian coordinate system
class CartWander(abm.Behavior.BehaviorBase):
    def __init__(self, weight, step):
        """Initialize CartWander behavior with specified weight and step size."""
        self.Weight = weight
        self.Step = step
    
    def Execute(self, agent):
        """Execute the wandering behavior based on agent attributes."""
        
        cartesianAgent = agent
        system = cartesianAgent.AgentSystem

        # Check if the agent's custom data meets specific criteria
        if cartesianAgent.CustomData['name'][1] == 'A':
            # Calculate a random rotation angle in radians
            randAngle = random.random() * math.pi
            
            # Define a movement vector along the X-axis and rotate it around Z-axis by randAngle
            wanderMove = self.Step * rg.Vector3d.XAxis
            wanderMove.Rotate(randAngle, rg.Vector3d.ZAxis)
            
            # Apply the movement to the agent with the specified weight
            cartesianAgent.AddMove(wanderMove, 'Wander')
            cartesianAgent.Weights.Add(self.Weight)
        
        else:
            return  # No action if criteria are not met

# Instantiate CartWander behavior with provided weight and step inputs
behavior = CartWander(iWeight, iStep)
oBehavior = behavior
# ---------- end python_3_script_2 ----------

# ---- group: AGENT SYSTEM / BEHAVIORS / PartnerCohesion
python_3_script_3 = Python3Script(iWeight=iweight_2)  # -> out, oBehavior
# ---------- python_3_script_3: Python ----------
"""
Computational Design and Simulation
assignment 01 - ABMS
students: Jonas Mertens, Likhinya Kvs
"""

import Rhino.Geometry as rg  # Import Rhino's geometry library for vector manipulation
import clr
clr.AddReference("ABxM.Core")  # Reference ABxM.Core for agent behavior management
import ABxM.Core as abm

# Define a custom behavior for partner cohesion among agents
class CartPartnerCohesion(abm.Behavior.BehaviorBase):
    def __init__(self, weight):
        """Initialize CartPartnerCohesion behavior with specified weight for cohesion."""
        self.Weight = weight
    
    def Execute(self, agent):
        """Execute the cohesion behavior based on partner matching criteria."""
        
        cartesianAgent = agent
        system = cartesianAgent.AgentSystem

        # Check if agent's custom data meets criteria for partner cohesion behavior
        if cartesianAgent.CustomData['name'][1] == 'B':
            for neighbor in system.Agents:
                # Check if the neighbor has the same identifier for cohesion
                if neighbor.CustomData['name'][0] == cartesianAgent.CustomData['name'][0]:
                    # Calculate a vector for moving towards the neighbor at a specified distance
                    moveToDistance = cartesianAgent.Position - neighbor.Position
                    moveToDistance.Unitize()
                    desiredMove = (neighbor.Position + neighbor.CustomData['distance'] * moveToDistance) - cartesianAgent.Position
                    
                    # Apply the movement and associated weight to the agent
                    cartesianAgent.Moves.Add(desiredMove)
                    cartesianAgent.Weights.Add(self.Weight)
        
        else:
            return  # No action if criteria are not met

# Instantiate CartPartnerCohesion behavior with the provided weight input
behavior = CartPartnerCohesion(iWeight)
oBehavior = behavior
# ---------- end python_3_script_3 ----------

# ---- group: AGENT SYSTEM / BEHAVIORS / Attraction
python_3_script_4 = Python3Script(iWeight=iweight_3, iRadius=iradius, iStep=istep_2)  # -> out, oBehavior
# ---------- python_3_script_4: Python ----------
"""
Computational Design and Simulation
assignment 01 - ABMS
students: Jonas Mertens, Likhinya Kvs
"""

import Rhino.Geometry as rg  # Import Rhino's geometry library for vector manipulation
import clr
clr.AddReference("ABxM.Core")  # Reference ABxM.Core for agent behavior management
import ABxM.Core as abm
import math

# Define a custom behavior for attraction among agents
class CartAttract(abm.Behavior.BehaviorBase):
    def __init__(self, weight, radius, step):
        """Initialize CartAttract behavior with specified weight, radius, and step size."""
        self.Weight = weight
        self.Radius = radius
        self.Step = step
    
    def Execute(self, agent):
        """Execute the attraction behavior for agents based on proximity and conditions."""
        
        cartesianAgent = agent
        system = cartesianAgent.AgentSystem

        # Check if agent has specific attributes for 'A' type and 'empty' docking status
        if cartesianAgent.CustomData['name'][1] == 'A' and cartesianAgent.CustomData['docking'] == 'empty':
            # Find nearby agents within the specified radius
            neighbors = system.FindNeighbors(cartesianAgent, self.Radius)
            if neighbors.Count == 0:
                return

            anchors = []
            # Identify eligible neighbors as anchors
            for neighbor in neighbors:
                if (neighbor.CustomData['name'][0] != cartesianAgent.CustomData['name'][0]
                    and neighbor.CustomData['name'][1] == 'B'
                    and neighbor.CustomData['docking'] == 'empty'):
                        anchors.append(neighbor)

            if anchors:
                # Select the closest anchor to the agent
                closestAnchor = min(anchors, key=lambda anchor: (cartesianAgent.Position - anchor.Position).Length)

                # Find the partner of the closest anchor and calculate direction to it
                memberDirection = rg.Vector3d(0.0, 0.0, 0.0)
                for agent in system.Agents:
                    if (agent.CustomData['name'][0] == closestAnchor.CustomData['name'][0]
                        and agent.CustomData['name'][1] != closestAnchor.CustomData['name'][1]):
                        memberDirection = agent.Position - closestAnchor.Position
                        memberDirection.Unitize()
                
                # Move agent towards the closest anchor, adjusting distance
                moveTowards = closestAnchor.Position + closestAnchor.CustomData['e'] * memberDirection - cartesianAgent.Position
                length = moveTowards.Length
                moveTowards.Unitize()
                moveTowards = self.Step * (0.1 + length) * moveTowards
                cartesianAgent.AddMove(moveTowards, 'Attraction')
                cartesianAgent.Weights.Add(self.Weight)

        # Handle case where 'A' type agent is already docked
        elif cartesianAgent.CustomData['name'][1] == 'A' and cartesianAgent.CustomData['docking'] != 'empty':
            neighbors = system.FindNeighbors(cartesianAgent, self.Radius)
            if neighbors.Count == 0:
                return

            # Search for specific neighbor based on docking information
            for neighbor in neighbors:
                if neighbor.CustomData['name'] == cartesianAgent.CustomData['docking']:
                    memberDirection = rg.Vector3d(0.0, 0.0, 0.0)
                    # Find partner of the docked neighbor and calculate direction
                    for agent in system.Agents:
                        if (agent.CustomData['name'][0] == neighbor.CustomData['name'][0]
                            and agent.CustomData['name'][1] != neighbor.CustomData['name'][1]):
                            memberDirection = agent.Position - neighbor.Position
                            memberDirection.Unitize()
                    
                    # Move agent towards docked partner
                    moveTowards = neighbor.Position + neighbor.CustomData['e'] * memberDirection - cartesianAgent.Position
                    length = moveTowards.Length
                    moveTowards.Unitize()
                    moveTowards = self.Step * (0.1 + length) * moveTowards
                    cartesianAgent.AddMove(moveTowards, 'Attraction')
                    cartesianAgent.Weights.Add(self.Weight)

        else:
            return  # No action if criteria are not met

# Instantiate CartAttract behavior with provided weight, radius, and step inputs
behavior = CartAttract(iWeight, iRadius, iStep)
oBehavior = behavior
# ---------- end python_3_script_4 ----------

# ---- group: AGENT SYSTEM / BEHAVIORS
merge = Merge(
    Data1=python_3_script_2.oBehavior,
    Data2=python_3_script_3.oBehavior,
    Data3=python_3_script_4.oBehavior,
    Data4=python_3_script.oBehavior)
behaviors = Data(merge)

# ---- group: AGENT SYSTEM / SOLVER / RUN SIM
button = Button()
toggle = BooleanToggle(False)

# ---- group: STOCK / STOCK SETTINGS
maxlength = Slider(1.5, range=0.1..3)
stockfactor = Slider(1.2, range=1..2)
anchor = Point(Point(0.3286059796, -3.482917903, 0))
minlength = Slider(1, range=0.1..3)

# ---- group: ENVIRONMENT
xy = XYPlane(Origin=Point(0, 0, 0))
random = Random(Range=Domain(-1, 1), Number=no_of_members, Seed=2)
random_2 = Random(Range=Domain(-1, 1), Number=no_of_members, Seed=3)
rectangle = Rectangle(Plane=xy, XSize=sizex, YSize=sizey, Radius=0)  # -> Rectangle, Length
pop2d = Populate2D(Region=rectangle.Rectangle, Count=no_of_members, Seed=seed)
vec = VectorXYZ(XComponent=random, YComponent=random_2, ZComponent=0)  # -> Vector, Length
list_length = ListLength(List=flatten(pop2d))

# ---- group: STOCK / STOCK SETTINGS (continued)
number = Number(list_length)

# ---- group: STOCK
randomstock = RandomStock(minlength=minlength, maxlength=maxlength, count=number, stockfactor=stockfactor, anchor=anchor)  # -> stock_2, lengths_2
stock = Curve(randomstock.stock_2)
lengths = Number(randomstock.lengths_2)

# ---- group: INITIALIZE MEMBER LENGTHS
membercount = Number(list_length)
stocklengths = Number(lengths)
list_length_2 = ListLength(List=stocklengths)
subtraction = Subtraction(A=list_length_2, B=membercount)
random_reduce = RandomReduce(List=stocklengths, Reduction=subtraction, Seed=1)
memberlengths = Number(random_reduce)

# ---- group: ENVIRONMENT (continued)
line = LineSDL(Start=pop2d, Direction=vec.Vector, Length=memberlengths)
line_2 = Line(line)

# ---- group: VISUALISATION
curve = Curve(line_2)
custom_preview = CustomPreview(Geometry=curve, Material=ColourSwatch(SwatchColor=RGB(128, 128, 128)))

# ---- group: AGENT SYSTEM / CUSTOM DATA
line_3 = Line(line_2)
end_points = EndPoints(Curve=graft(line_3))  # -> simplify(Start), simplify(End)
python = GhPythonScript(iStart=end_points.Start, iEnd=end_points.End)  # -> out, oNamesA, oNamesB; inputs iStart: tree, iEnd: tree
# ---------- python: Python ----------
import Grasshopper as gh

# Get the paths of the input data tree
startPaths = iStart.Paths
endPaths = iEnd.Paths

# Convert each path to a string representation
stringsStart = [str(path).strip("{}") + "A"  for path in startPaths]
stringsEnd = [str(path).strip("{}") + "B" for path in endPaths]

# Output the list of path strings
oNamesA = stringsStart
oNamesB = stringsEnd
# ---------- end python ----------
engagementdistance_2 = Number(engagementdistance)
length = Length(Curve=line_3)
list_length_3 = ListLength(List=line_3)
keyword_for_no_docking = Panel("empty")
repeat_data = RepeatData(Data=engagementdistance_2, Length=expr("x*2", list_length_3))
repeat_data_2 = RepeatData(Data=keyword_for_no_docking, Length=expr("x*2", list_length_3))
merge_2 = Merge(Data1=python.oNamesA, Data2=python.oNamesB)
merge_3 = Merge(Data1=python.oNamesB, Data2=python.oNamesA)
merge_4 = Merge(Data1=length, Data2=length)
engagementdistance_3 = Number(repeat_data)
dockingagent = Text(repeat_data_2)
partnername = Text(merge_3)
agentname = Text(merge_2)
distance = Number(merge_4)
dict = CSharpScript(
    K="name",
    V=agentname,
    Reference="C:\Users\Jonas\AppData\Roaming\McNeel\Rhinoceros\packages\8.0\ABxM-Core\1.5.7\ABxM.Core.dll")  # -> D; inputs K: String, V: list
# ---------- dict: C# ----------
    List<Dictionary<string, object>> customData = new List<Dictionary<string, object>>();

    foreach(object myValue in V)
    {
      Dictionary<string, object> myData = new Dictionary<string, object>();
      myData.Add(K, myValue);
      customData.Add(myData);
    }


    D = customData;
# ---------- dict: C# additional code ----------
  /// <summary>
  /// This method will be called once every solution, before any calls to RunScript.
  /// </summary>
  public override void BeforeRunScript()
  { }
  /// <summary>
  /// This method will be called once every solution, after any calls to RunScript.
  /// </summary>
  public override void AfterRunScript()
  { }
# ---------- end dict ----------
dict_2 = CSharpScript(
    K="partner",
    V=partnername,
    Reference="C:\Users\Jonas\AppData\Roaming\McNeel\Rhinoceros\packages\8.0\ABxM-Core\1.5.7\ABxM.Core.dll")  # -> D; inputs K: String, V: list; same code as dict
dict_3 = CSharpScript(
    K="distance",
    V=distance,
    Reference="C:\Users\Jonas\AppData\Roaming\McNeel\Rhinoceros\packages\8.0\ABxM-Core\1.5.7\ABxM.Core.dll")  # -> D; inputs K: String, V: list; same code as dict
dict_4 = CSharpScript(
    K="e",
    V=engagementdistance_3,
    Reference="C:\Users\Jonas\AppData\Roaming\McNeel\Rhinoceros\packages\8.0\ABxM-Core\1.5.7\ABxM.Core.dll")  # -> D; inputs K: String, V: list; same code as dict
dict_5 = CSharpScript(
    K="docking",
    V=dockingagent,
    Reference="C:\Users\Jonas\AppData\Roaming\McNeel\Rhinoceros\packages\8.0\ABxM-Core\1.5.7\ABxM.Core.dll")  # -> D; inputs K: String, V: list; same code as dict
entwine = Entwine(Branch00=dict, Branch01=dict_2, Branch02=dict_3, Branch03=dict_4, Branch04=dict_5, FlattenInputs=True)  # -> simplify(Result)
cluster = Cluster(D=entwine)
customdata = Data(cluster)

# ---- group: AGENT SYSTEM / START POSITIONS
end_points_2 = EndPoints(Curve=line_3)  # -> Start, End
merge_5 = Merge(Data1=end_points_2.Start, Data2=end_points_2.End)
startpositions = Point(merge_5)

# ---- group: AGENT SYSTEM
define_cartesian_agent = DefineCartesianAgent(Positions=startpositions, Behaviors=behaviors, CustomData=customdata)
define_cartesian_agent_system = DefineCartesianAgentSystem(CartesianAgents=define_cartesian_agent, ComputeDiagram=0)

# ---- group: AGENT SYSTEM / SOLVER
data = Data(define_cartesian_agent_system)
solver = StepByStepSolver(Reset=button, Execute=toggle, AgentSystems=data)  # -> DisplayGeometries, AllAgentSystems, IterationCount
ticks = Panel(solver.IterationCount)

# ---- group: AGENT SYSTEM
agentsystem = Data(solver.AllAgentSystems)

# ---- group: RESULTS
agentsystem_2 = Data(agentsystem)
python_2 = GhPythonScript(iAS=agentsystem_2)  # -> out, oA, oB, oDockingA, oDockingB, oNames
# ---------- python_2: Python ----------
positionsA = []
positionsB = []
dockingA = []
dockingB = []
names = []

if iAS:
    for agent in iAS.Agents:
        position = agent.Position
        names.append(agent.CustomData['name'])
        if agent.CustomData['name'][1] == 'A':
            positionsA.append(position)
            dockingA.append(agent.CustomData['docking'])
        else:
            positionsB.append(position)
            dockingB.append(agent.CustomData['docking'])

oA = positionsA
oB = positionsB
oDockingA = dockingA
oDockingB = dockingB
oNames = names
# ---------- end python_2 ----------
merge_6 = Merge(Data1=python_2.oA, Data2=python_2.oB)
line_4 = Line(StartPoint=python_2.oA, EndPoint=python_2.oB)

# ---- group: RESULTS / VISUALIZATION
colour_swatch = ColourSwatch(SwatchColor=RGB(255, 136, 0))
text_tag = TextTag(Location=merge_6, Text=python_2.oNames, Colour=colour_swatch)
custom_preview_2 = CustomPreview(Geometry=line_4, Material=colour_swatch)

# ---- group: RESULTS / DOCKING
agents = Panel(python_2.oNames)
docking = Panel(python_2.oDockingA)
panel = Panel(python_2.oDockingB)

# ==== cluster RandomStock
minlength = ClusterInput()
maxlength = ClusterInput()
count = ClusterInput()
stockfactor = ClusterInput()
anchor = ClusterInput()
minlength_2 = Number(minlength)
maxlength_2 = Number(maxlength)
count_2 = Number(count)
stockfactor_2 = Number(stockfactor)
anchor_2 = Point(anchor)

construct_domain = ConstructDomain(DomainStart=minlength_2, DomainEnd=maxlength_2)
multiplication = Multiplication(A=count_2, B=stockfactor_2)
deconstruct = Deconstruct(Point=anchor_2)  # -> XComponent, YComponent, ZComponent
unit_y = UnitY(Factor=1)
random = Random(Range=construct_domain, Number=multiplication, Seed=2)
series = Series(Start=deconstruct.XComponent, Step="0.2", Count=multiplication)
construct_point = ConstructPoint(XCoordinate=series, YCoordinate=deconstruct.YComponent, ZCoordinate=deconstruct.ZComponent)
line_sdl = LineSDL(Start=construct_point, Direction=unit_y, Length=random)

stock = Curve(line_sdl)
lengths = Number(random)
stock_2 = ClusterOutput(stock)
lengths_2 = ClusterOutput(lengths)

# ==== cluster Cluster
D = ClusterInput()
flip = FlipMatrix(Data=D)
c_script = CSharpScript(
    Dictionaries=flip,
    Reference="C:\USERS\JONAS\APPDATA\ROAMING\MCNEEL\RHINOCEROS\PACKAGES\8.0\ABXM-CORE\1.5.7\ABxM.Core.dll")  # -> CustomData; inputs Dictionaries: tree
# ---------- c_script: C# usings ----------
using ABxM.Core.Agent;
# ---------- c_script: C# ----------
    List<Dictionary<string, object>> customData = new List<Dictionary<string, object>>();


    for (int i = 0; i < Dictionaries.BranchCount; i++)
    {
      Dictionary<string, object> myData = new Dictionary<string, object>();

      for (int j = 0; j < Dictionaries.Branch(i).Count; j++)
      {
        Dictionary < string, object > dict = Dictionaries.Branch(i)[j] as Dictionary < string, object >;

        string key = null;
        object val = null;
        foreach( KeyValuePair<string, object> kvp in dict )
          myData.Add(kvp.Key, kvp.Value);

      }
      customData.Add(myData);
    }


    CustomData = customData;
# ---------- c_script: C# additional code ----------
  /// <summary>
  /// This method will be called once every solution, before any calls to RunScript.
  /// </summary>
  public override void BeforeRunScript()
  { }
  /// <summary>
  /// This method will be called once every solution, after any calls to RunScript.
  /// </summary>
  public override void AfterRunScript()
  { }
# ---------- end c_script ----------
customdata = ClusterOutput(c_script)
